# Grasshopper definition CSharpWIP (2).gh (Grasshopper 0.9.76)
# plug-ins: ClipperComponents

format = Format(Culture=127)
number_slider = Slider(2, range=0..10)
number_slider_2 = Slider(1, range=0..1, expression="-x")
curve = Curve([<curve referenced from the Rhino model> x2])
curve_2 = Curve(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)
curve_3 = Curve(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)
number_slider_3 = Slider(9, range=0..19)
number_slider_4 = Slider(17, range=0..19)
number_slider_5 = Slider(180, range=0..360)
discontinuity = Discontinuity(Curve=curve, Level=1)  # -> Points, Parameters
curve_4 = Curve([<curve referenced from the Rhino model> x2])
c_script = CSharpScript(x=curve_4, y=Slider(9, range=0..100), z=Slider(50, range=0..100), u=Slider(100, range=0..100))  # -> out, A, B, C, D, E, F; inputs x: list of Curve, y: Int32, z: Int32, u: Int32
# ---------- c_script: C# ----------
    List<Curve> cur = x;

    Curve c = cur[0];
    Curve cO = cur[1];

    Point3d[] pointsA;
    Point3d[] pointsB;

    if(y == 0 || y == 1)
    {

      y = 2;

    }

    c.DivideByCount(y, true, out pointsA);
    cO.DivideByCount(y, true, out pointsB);

    if(z > y - 1)
    {

      z = y - 1;

    }

    if(z == 0)
    {

      z = 1;

    }

    if(u > y - 1)
    {

      u = y - 1;

    }

    Vector3d referencePoint = new Vector3d(pointsA[0]);
    Vector3d vO = new Vector3d(pointsA[u]);
    Point3d p = new Point3d(pointsB[z]);
    Vector3d vT = new Vector3d(p);

    vT -= vO;
    c.Translate(vT);

    Rhino.Geometry.Intersect.CurveIntersections ci;
    ci = Rhino.Geometry.Intersect.Intersection.CurveCurve(c, cO, 0.001, 0.001);
    Point3d[] intPtsO = new Point3d[ci.Count];

    for(int i = 0; i < ci.Count; i++)
    {

      intPtsO[i] = ci[i].PointA;

    }

    //List<Point3d> pt = new List<Point3d>();

    for( int i = 0; i < y; i++ )
    {

      //pt.Add(pointsA[i]);

      if(ci.Count > 1)
      {

        vO = new Vector3d(intPtsO[0]);
        p = pointsB[i];
        vT = new Vector3d(p);

        vT -= vO;
        c.Translate(vT);

        ci = Rhino.Geometry.Intersect.Intersection.CurveCurve(c, cO, 0.001, 0.001);
        intPtsO = new Rhino.Geometry.Point3d[ci.Count];

        for(int j = 0; j < ci.Count; j++)
        {

          intPtsO[j] = ci[j].PointA;

        }

      }

    }

    A = c;
    B = cO;
    C = p;
    D = intPtsO;
    E = pointsA;
# ---------- end c_script ----------
c_script_2 = CSharpScript(
    A=curve_2,
    B=curve_3,
    x=Slider(20, range=0..50),
    l=Slider(0, range=0..100),
    y=number_slider_3,
    z=number_slider_4,
    u=number_slider_5)  # -> out, AOut, APoints, BPoints, End, CurveA, CurveB, Intersect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; inputs A: Curve, B: Curve, x: Int32, l: Int32, y: Int32, z: Int32, u: Double
# ---------- c_script_2: C# ----------
    Curve a = A;
    Point3d[] pointsA;
    a.DivideByCount(x, true, out pointsA);

    Curve b = B;
    Point3d[] pointsB;
    b.DivideByCount(x, true, out pointsB);

    //End = b.PointAtEnd;


    if(l > x - 1)
    {

      l = (x - 1);
      outs = String.Format("l index is bigger than the size of the x collection");

    }

    /*
    List<Point3d> pointList = new List<Point3d>();
    for( int i = 0; i < pointsA.Length; i++ )
    {
      pointList.Add(pointsA[i]);
    }
    //foreach(Point3d point in pointList){}
    */

    Vector3d vec = new Vector3d(pointsB[l]);
    Vector3d one = new Vector3d(a.PointAtEnd);
    vec -= one;

    a.Translate(vec);

    CurveA = a;
    CurveB = b;

    Rhino.Geometry.Intersect.CurveIntersections ci;
    ci = Rhino.Geometry.Intersect.Intersection.CurveCurve(a, b, 0.001, 0.001);
    Point3d[] intPts = new Rhino.Geometry.Point3d[ci.Count];

    Point3d[] ptsA;
    a.DivideByCount(x, true, out ptsA);
    two = ptsA;

    End = a.PointAtEnd;

    for(int i = 0; i < ci.Count; i++)
    {

      intPts[i] = ci[i].PointA;

    }
    Intersect = intPts;

    if(ci.Count > 1)
    {


      Vector3d vO = new Vector3d(ptsA[z]);
      three = vO;
      Vector3d vT = new Vector3d(pointsB[y]);
      three = vT;
      vT -= vO;
      a.Translate(vT);

      /*
      Random r = new Random();
      foreach (int i in Enumerable.Range(0, 9).OrderBy(t => r.Next()))
      {
        four = i;
      }
      */

      /*
      List<Vector3d> pAList = new List<Vector3d>();
      Vector3d pA;
      List<Vector3d> pBList = new List<Vector3d>();
      Vector3d pB;
      */
      /*
      for(int i = 0; i < x; ++i)
      {

        //Vector3d[] p = new Vector3d[](ptsA[i]);
        //Vector3d[] pO = new Vector3d[](pointsB[j]);
        //p -= pO;
        //three = p;
        //a.Translate(p[1]);
        pA = new Vector3d(ptsA[i]);
        pB = new Vector3d(pointsB[i]);
        pAList.Add(pA);
        pBList.Add(pB);
        three = pAList;
        four = pBList;

      }
      */

      //a.Rotate(u * (Math.PI / 180), Vector3d.ZAxis, pointsB[y]);

      Rhino.Geometry.Intersect.CurveIntersections c;
      c = Rhino.Geometry.Intersect.Intersection.CurveCurve(a, b, 0.001, 0.001);
      Point3d[] intPtsO = new Rhino.Geometry.Point3d[c.Count];

      for(int i = 0; i < c.Count; i++)
      {

        intPtsO[i] = c[i].PointA;

      }
      IntersectTwo = intPtsO;
      four = c.Count;

      //Point3d p = new Point3d(ci[0].PointA);

      //Vector3d v = new Vector3d(p);

      /*
      Vector3d vO = new Vector3d(pointsA[l]);
      vec += vO;
      a.Translate(vec);
      */

      //Transform trans = Transform.Rotation(u, vec, ci[0].PointA);

      outs = String.Format("More than one collision");
      //oner = v;

    }

    else if( ci.Count == 1 )
    {

      outs = String.Format("Only one collision");

    }

    APoints = pointsA;
    BPoints = pointsB;
    AOut = String.Format(a + "\n" + b);
    //End = Counter();
# ---------- c_script_2: C# additional code ----------
  public Point3d Counter()
  {

    Point3d pt = new Point3d(1, 1, 1);
    return pt;

  }
# ---------- end c_script_2 ----------
c_script_3 = CSharpScript(x=curve, y=Slider(65.184, range=0..100), z=Slider(3, range=0..5))  # -> out, A, B, C, D, E; inputs x: list of Polyline, y: Double, z: Int32
# ---------- c_script_3: C# ----------
    List<Polyline> poly = x;

    var ptsA = new List<Point3d>();
    Polyline one = poly[1];
    ptsA = one.ToList();
    A = ptsA;

    var ptsB = new List<Point3d>();
    Polyline two = poly[0];
    ptsB = two.ToList();
    B = ptsB;

    Point3d ptA = ptsA[0];
    Point3d ptB = ptsB[z];

    Curve oneN = one.ToNurbsCurve();
    Vector3d vecA = new Vector3d(ptA);
    Vector3d vecB = new Vector3d(ptB);
    Vector3d fin = vecB - vecA;
    oneN.Translate(fin);
    C = oneN;

    Curve twoN = two.ToNurbsCurve();

    Rhino.Geometry.Intersect.CurveIntersections ci;
    ci = Rhino.Geometry.Intersect.Intersection.CurveCurve(oneN, twoN, 0.001, 0.001);
    Point3d[] intPtsO = new Rhino.Geometry.Point3d[ci.Count];

    for(int i = 0; i < ci.Count; i++)
    {

      intPtsO[i] = ci[i].PointA;

    }

    D = intPtsO;

    if(ci.Count > 1)
    {

      //oneN.DivideByCount();

      /*ptA = ptsA[1];
      vecA = new Vector3d(ptA);
      fin = vecB - vecA;
      oneN.Translate(fin);
      C = oneN;
      E = fin;
      */
    }
# ---------- end c_script_3 ----------
panel = Panel(c_script.F)
curve_5 = Curve(c_script_3.C)
point = Point(c_script_3.A)
cull_index = CullIndex(List=point, Indices=number_slider_2, Wrap=True)
point_list = PointList(Points=cull_index)
panel_2 = Panel(cull_index)
partition_list = PartitionList(List=panel_2, Size=number_slider)  # -> simplify(Chunks)
partition_list_2 = PartitionList(List=panel_2, Size=number_slider)  # -> reverse(simplify(Chunks))
partition_list_3 = PartitionList(List=panel_2, Size=Slider(2, range=0..10))  # -> simplify(Chunks)
split_list = SplitList(List=cull_index, Index=Slider(2, range=0..10))  # -> ListA, ListB
panel_3 = Panel(partition_list)
explode_tree = ExplodeTree(Data=panel_3)  # -> Branch0, Branch1
panel_4 = Panel(partition_list_2)
explode_tree_2 = ExplodeTree(Data=panel_4)  # -> Branch0, Branch1
point_2 = Point(split_list.ListB)
point_3 = Point(split_list.ListA)
panel_5 = Panel(partition_list_3)
list_item = ListItem(List=explode_tree_2.Branch0, Index=Slider(1, range=0..100), Wrap=True)
list_item_2 = ListItem(List=partition_list_3, Index=Slider(0, range=0..100), Wrap=True)
list_item_3 = ListItem(List=explode_tree.Branch0, Index=Slider(1, range=0..100), Wrap=True)
list_item_4 = ListItem(List=explode_tree_2.Branch1, Index=Slider(0, range=0..1), Wrap=True)
list_item_5 = ListItem(List=partition_list_3, Index=Slider(1, range=0..1), Wrap=True)
list_item_6 = ListItem(List=explode_tree.Branch1, Index=Slider(0, range=0..1), Wrap=True)
list_item_7 = ListItem(List=split_list.ListA, Index=Slider(0, range=0..1), Wrap=True)
list_item_8 = ListItem(List=explode_tree_2.Branch0, Index=Slider(0, range=0..100), Wrap=True)
list_item_9 = ListItem(List=split_list.ListA, Index=Slider(1, range=0..1), Wrap=True)
list_item_10 = ListItem(List=split_list.ListB, Index=Slider(1, range=0..1), Wrap=True)
list_item_11 = ListItem(List=split_list.ListB, Index=Slider(0, range=0..1), Wrap=True)
list_item_12 = ListItem(List=explode_tree_2.Branch1, Index=Slider(1, range=0..1), Wrap=True)
panel_6 = Panel(point)
point_4 = Point(list_item_2)
point_5 = Point(list_item_5)
point_6 = Point(list_item_4)
point_7 = Point(list_item)
point_8 = Point(list_item_6)
point_9 = Point(list_item_3)
point_10 = Point(list_item_12)
point_11 = Point(list_item_8)
vector_2pt = Vector2Pt(PointA=list_item_10, PointB=list_item_7, Unitize=False)  # -> Vector, Length
vector_2pt_2 = Vector2Pt(PointA=list_item_9, PointB=list_item_11, Unitize=False)  # -> Vector, Length
vector_2pt_3 = Vector2Pt(PointA=list_item_2, PointB=list_item_5, Unitize=False)  # -> Vector, Length
vector_2pt_4 = Vector2Pt(PointA=list_item_4, PointB=list_item, Unitize=False)  # -> Vector, Length
vector_2pt_5 = Vector2Pt(PointA=list_item_3, PointB=list_item_6, Unitize=False)  # -> Vector, Length
vector_2pt_6 = Vector2Pt(PointA=list_item_12, PointB=list_item_8, Unitize=False)  # -> Vector, Length
shift_list = ShiftList(List=panel_5, Shift=number_slider_2, Wrap=False)
vector_display = VectorDisplay(Anchor=list_item_10, Vector=vector_2pt.Vector)
vector_display_2 = VectorDisplay(Anchor=list_item_9, Vector=vector_2pt_2.Vector)
vector_display_3 = VectorDisplay(Anchor=list_item_2, Vector=vector_2pt_3.Vector)
vector_display_4 = VectorDisplay(Anchor=list_item_4, Vector=vector_2pt_4.Vector)
vector_display_5 = VectorDisplay(Anchor=list_item_3, Vector=vector_2pt_5.Vector)
vector_display_6 = VectorDisplay(Anchor=list_item_12, Vector=vector_2pt_6.Vector)
panel_8 = Panel(shift_list)
point_12 = Point(c_script_3.B)
list_length = ListLength(List=point_12)
panel_9 = Panel(list_length)
list_item_13 = ListItem(List=point_12, Index=Slider(0, range=0..7), Wrap=True)
list_item_14 = ListItem(List=point_12, Index=Slider(1, range=0..7), Wrap=True)
list_item_15 = ListItem(List=point_12, Index=Slider(2, range=0..7), Wrap=True)
list_item_16 = ListItem(List=point_12, Index=Slider(1, range=0..7), Wrap=True)
list_item_17 = ListItem(List=point_12, Index=Slider(3, range=0..7), Wrap=True)
list_item_18 = ListItem(List=point_12, Index=Slider(2, range=0..7), Wrap=True)
list_item_19 = ListItem(List=point_12, Index=Slider(3, range=0..7), Wrap=True)
list_item_20 = ListItem(List=point_12, Index=Slider(4, range=0..7), Wrap=True)
list_item_21 = ListItem(List=point_12, Index=Slider(5, range=0..7), Wrap=True)
list_item_22 = ListItem(List=point_12, Index=Slider(4, range=0..7), Wrap=True)
list_item_23 = ListItem(List=point_12, Index=Slider(5, range=0..7), Wrap=True)
list_item_24 = ListItem(List=point_12, Index=Slider(6, range=0..7), Wrap=True)
point_13 = Point(c_script_3.D)
point_14 = Point(c_script_3.E)
aoriginalpoints = Point(c_script_2.APoints)
boriginalpoints = Point(c_script_2.BPoints)
intersecttwo = Point(c_script_2.IntersectTwo)
intersectone = Point(c_script_2.Intersect)
pointanew = Point(c_script_2.two)
endpoints = Point(c_script_2.End)
panel_10 = Panel(c_script_2.oner)
curvea = Curve(c_script_2.CurveA)
curveb = Curve(c_script_2.CurveB)
point_15 = Point(c_script_2.three)
panel_11 = Panel(c_script_2.outs)
vector_2pt_7 = Vector2Pt(PointA=list_item_13, PointB=list_item_14, Unitize=False)  # -> Vector, Length
vector_2pt_8 = Vector2Pt(PointA=list_item_15, PointB=list_item_17, Unitize=False)  # -> Vector, Length
vector_2pt_9 = Vector2Pt(PointA=list_item_16, PointB=list_item_18, Unitize=False)  # -> Vector, Length
vector_2pt_10 = Vector2Pt(PointA=list_item_19, PointB=list_item_22, Unitize=False)  # -> Vector, Length
vector_2pt_11 = Vector2Pt(PointA=list_item_20, PointB=list_item_23, Unitize=False)  # -> Vector, Length
vector_2pt_12 = Vector2Pt(PointA=list_item_21, PointB=list_item_24, Unitize=False)  # -> Vector, Length
vector = Vector(c_script_2.oner)
panel_12 = Panel(intersectone)
panel_13 = Panel(endpoints)
panel_14 = Panel(intersecttwo)
panel_15 = Panel(pointanew)
panel_16 = Panel(c_script_2.three)
panel_17 = Panel(c_script_2.four)
B = Curve(c_script.B)
E = Point(c_script.E)
A = Curve(c_script.A)
C = Point(c_script.C)
D = Point(c_script.D)
partition_list_4 = PartitionList(List=point, Size="4")
panel_18 = Panel(partition_list_4)
vector_display_7 = VectorDisplay(Anchor=list_item_13, Vector=vector_2pt_7.Vector)
vector_display_8 = VectorDisplay(Anchor=list_item_15, Vector=vector_2pt_8.Vector)
vector_display_9 = VectorDisplay(Anchor=list_item_16, Vector=vector_2pt_9.Vector)
vector_display_10 = VectorDisplay(Anchor=list_item_19, Vector=vector_2pt_10.Vector)
vector_display_11 = VectorDisplay(Anchor=list_item_20, Vector=vector_2pt_11.Vector)
vector_display_12 = VectorDisplay(Anchor=list_item_21, Vector=vector_2pt_12.Vector)
point_list_2 = PointList(Points=point, Size=Slider(95.76, range=0..200))
bounding_box = BoundingBox(Content=curveb, Plane=PlaneXY(0, 0, 0))  # -> Box, Box_2
bounding_box_2 = BoundingBox(Content=curvea, Plane=PlaneXY(0, 0, 0))  # -> Box, Box_2
brep = Brep(curveb)
brep_2 = Brep(curvea)
number = Number(panel_17)
galapagos = Galapagos(fitness=addition, gene=[number_slider_3, number_slider_4, number_slider_5])
tree_branch = TreeBranch(Tree=partition_list_4, Path="{0;0;0}", MaintainPaths=True)
reverse_list = ReverseList(List=tree_branch)
panel_19 = Panel(reverse_list)
divide_curve = DivideCurve(Curve=curvea, Count=Slider(40, range=0..100), Kinks=False)  # -> Points, Tangents, Parameters
curve_6 = Curve([<curve referenced from the Rhino model> x3])
discontinuity_2 = Discontinuity(Curve=curve_6, Level=1)  # -> Points, Parameters
panel_20 = Panel(discontinuity_2.Points)
shatter = Shatter()
multiple_curves = MultipleCurves(Curves=curve_6)  # -> Points, IndexA, IndexB, ParamA, ParamB
perp_frame = PerpFrame(Curve=curvea, Parameter=divide_curve.Parameters)
curve_7 = Curve([<curve referenced from the Rhino model> x4])
point_list_3 = PointList(Points=discontinuity_2.Points, Size=Slider(200, range=0..200))
deconstruct_plane = DeconstructPlane(Plane=perp_frame)  # -> Origin, XAxis, YAxis, ZAxis
area = Area(Geometry=[bounding_box.Box, bounding_box_2.Box])  # -> Area, Centroid
number_slider_6 = Slider(0, range=0..10)
curve_8 = Curve([<curve referenced from the Rhino model> x2])
curve_9 = Curve([<curve referenced from the Rhino model> x8])
curve_10 = Curve(<curve referenced from the Rhino model>)
curve_11 = Curve(<curve referenced from the Rhino model>)
line_sdl = LineSDL(Start=perp_frame, Direction=deconstruct_plane.YAxis, Length=Slider(100, range=0..100))
list_item_25 = ListItem(List=curve_8, Index=Slider(0, range=0..1), Wrap=True)
deconstruct_brep = DeconstructBrep(Brep=curve_10)  # -> Faces, Edges, Vertices
list_item_26 = ListItem(List=curve_8, Index=Slider(1, range=0..1), Wrap=True)
number_slider_7 = Slider(2, range=0..4)
mass_addition = MassAddition(Input=area.Area)  # -> Result, PartialResults
c_script_4 = CSharpScript(
    x=curve_9,
    y=number_slider_6,
    Reference="C:\PROGRAM FILES\COMMON FILES\MCNEEL\RHINOCEROS\5.0\PLUG-INS\CLIPPERPLUGIN (BAE0724C-D28B-4D54-9B02-806B19D157C2)\0.0.2.1\CLIPPER-0.2.2\ClipperTools.dll")  # -> out, A, B, C; inputs x: list of Polyline, y: Int32
# ---------- c_script_4: C# ----------
    Polyline[] one = new Polyline[x.Count];
    Curve[] two = new Curve[x.Count];
    double[] areas = new Double[x.Count];
    var curves = new List<KeyValuePair<Curve, double>>();

    for(int i = 0; i < x.Count; ++i)
    {

      one[i] = new Polyline(x[i]);
      two[i] = one[i].ToNurbsCurve();
      areas[i] = AreaMassProperties.Compute(two[i]).Area;
      curves.Add(new KeyValuePair<Curve, double>(two[i], areas[i]));

    }

    curves.Sort(Compare1);
    curves.Reverse();
    List<Curve> curve = (from kvp in curves select kvp.Key).Distinct().ToList();
    curve.Reverse();

    Curve[] curvesOne = curve.ToArray();
    Polyline[] poly = new Polyline[curve.Count];
    var poi = new List<Point3d>();
    //List<Point3d>[] pts = new List<Point3d>[curvesOne.Length];
    List<List<Point3d>> pts = new List<List<Point3d>>();
    for(int i = 0; i < curve.Count; ++i)
    {

      curvesOne[i].TryGetPolyline(out poly[i]);
      pts.Add(poly[i].ToList());
      pts[i].RemoveAt(pts[i].Count - 1);
      //pts[i] = poly[i].ToList();

    }

    /*
    A = pts[0][pts[0].Count - 1];

    Point3d center = pts[0][pts[0].Count - 1];
    Vector3d zAxis = Vector3d.ZAxis;
    Plane p = new Rhino.Geometry.Plane(center, zAxis);
    */

    Point3d[] points = new Point3d[curve.Count];
    for(int i = 0; i < points.Length; ++i)
    {

      points[i] = new Point3d(pts[i][0]);

    }

    A = poly;

    B = points;
    
    C = points;

    Point3d centerOne = points[1];
    Vector3d zAxis = Vector3d.ZAxis;
    Plane pO = new Rhino.Geometry.Plane(centerOne, zAxis);

    double tolerance = 0.001;
    List<Polyline> outCurvesOne = new List<Polyline>();
    List<Polyline> outDisplacedCurvesOne = new List<Polyline>();
    foreach(List<IntPoint> path in ClipperLib.Clipper.MinkowskiDiff(poly[1].ToPath2D(pO, tolerance), poly[points.Length - 1].ToPath2D(pO, tolerance)))
    {

      Polyline plSum = path.ToPolyline(pO, tolerance, true);
      outCurvesOne.Add(plSum);

    }
    Polyline bin = outCurvesOne[1];

    //C = bin;


    /*
    // No Fit Polygon One
    double tolerance = 0.001;
    List<Polyline> outCurves = new List<Polyline>();
    List<Polyline> outDisplacedCurves = new List<Polyline>();
    foreach(List<IntPoint> path in ClipperLib.Clipper.MinkowskiDiff(two.ToPath2D(p, tolerance), one.ToPath2D(p, tolerance)))
    {

    Polyline plSum = path.ToPolyline(p, tolerance, true);
    outCurves.Add(plSum);

    }

    Polyline NFP = outCurves[0];

    A = curve;
    */
# ---------- c_script_4: C# additional code ----------
  static int Compare1(KeyValuePair<Curve, double> a, KeyValuePair<Curve, double> b)
  {
    return a.Value.CompareTo(b.Value);
  }
# ---------- end c_script_4 ----------
list_length_2 = ListLength(List=c_script_4.B)
list_length_3 = ListLength(List=c_script_4.A)
subtraction = Subtraction(A=list_length_2, B=1)
subtraction_2 = Subtraction(A=list_length_3, B=1)
cull_index_2 = CullIndex(List=c_script_4.B, Indices=subtraction, Wrap=True)
cull_index_3 = CullIndex(List=c_script_4.A, Indices=subtraction_2, Wrap=True)
panel_21 = Panel(cull_index_3)
cull_index_4 = CullIndex(List=cull_index_2, Indices=0, Wrap=True)
cull_index_5 = CullIndex(List=cull_index_3, Indices=0, Wrap=True)
area_2 = Area(Geometry=curve_9)  # -> Area, Centroid
number_slider_8 = Slider(0, range=0..5)
difference = CSharpScript(
    z=Slider(2, range=0..10),
    u=curve_7,
    w=Slider(8, range=0..10),
    Reference=["C:\PROGRAM FILES\COMMON FILES\MCNEEL\RHINOCEROS\5.0\PLUG-INS\CLIPPERPLUGIN (BAE0724C-D28B-4D54-9B02-806B19D157C2)\0.0.2.1\CLIPPER-0.2.2\ClipperTools.dll", "C:\Users\Paula\AppData\Roaming\Grasshopper\Libraries\PlanktonGh.dll", "C:\Users\Paula\AppData\Roaming\Grasshopper\Libraries\Plankton.dll"])  # -> out, A, B, C, D, E, F, AA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; inputs z: Int32, u: list of Polyline, w: Int32
# ---------- difference: C# ----------
    Polyline four = u[3];
    Polyline one = u[2];
    Polyline two = u[1];
    Polyline three = u[0];

    List<Point3d> ptA;
    ptA = one.ToList();
    ptA.RemoveAt(0);

    List<Point3d> ptB;
    ptB = two.ToList();
    ptB.RemoveAt(0);

    List<Point3d> ptC;
    ptC = three.ToList();
    ptC.RemoveAt(0);

    Point3d center = ptB[ptB.Count - 1];
    Vector3d zAxis = Vector3d.ZAxis;
    Plane p = new Rhino.Geometry.Plane(center, zAxis);

    // No Fit Polygon One
    double tolerance = 0.001;
    List<Polyline> outCurves = new List<Polyline>();
    List<Polyline> outDisplacedCurves = new List<Polyline>();
    foreach(List<IntPoint> path in ClipperLib.Clipper.MinkowskiDiff(two.ToPath2D(p, tolerance), one.ToPath2D(p, tolerance)))
    {

      Polyline plSum = path.ToPolyline(p, tolerance, true);
      outCurves.Add(plSum);

    }

    Polyline NFP = outCurves[0];

    List<Point3d> ptNFP;
    ptNFP = NFP.ToList();
    ptNFP.RemoveAt(0);

    // Inner Fit Polygon
    Point3d centerOne = ptB[ptB.Count - 1];
    Plane pO = new Rhino.Geometry.Plane(centerOne, zAxis);

    List<Polyline> outCurvesOne = new List<Polyline>();
    List<Polyline> outDisplacedCurvesOne = new List<Polyline>();
    foreach(List<IntPoint> path in ClipperLib.Clipper.MinkowskiDiff(two.ToPath2D(pO, tolerance), three.ToPath2D(pO, tolerance)))
    {

      Polyline plSum = path.ToPolyline(pO, tolerance, true);
      outCurvesOne.Add(plSum);

    }

    Polyline bin = outCurvesOne[1];

    // No Fit Polygon Two
    List<Polyline> outCurvesTwo = new List<Polyline>();
    List<Polyline> outDisplacedCurvesTwo = new List<Polyline>();
    foreach(List<IntPoint> path in ClipperLib.Clipper.MinkowskiDiff(two.ToPath2D(p, tolerance), four.ToPath2D(p, tolerance)))
    {

      Polyline plSum = path.ToPolyline(p, tolerance, true);
      outCurvesTwo.Add(plSum);

    }

    Polyline NFPOne = outCurvesTwo[0];


    Curve b = two.ToNurbsCurve();
    int[] iter = new int[5];
    int[] iterOne = new int[5];
    int[] iterTwo = new int[5];
    Vector3d[] vec = new Vector3d[ptA.Count];
    for(int i = 0; i < 5; ++i)
      for(int j = 0; j < 5 - 1; ++j)
      {

        iter[i] = i;
        iterOne[j] = j;
        //vec[i] = new Vector3d(i,i,i);

        if(iter[i] < iterOne[j])
        {

          iterTwo[i] = i;

        }
        else
        {

          iterTwo[j] = j;

        }

        AD = iter;
        AE = iterOne;
        AF = iterTwo;

      }

    //AD = vec;

    /*
    Vector3d[] vecOne = new Vector3d[ptB.Count];
    for(int i = 0; i < ptB.Count; ++i)
    {

    vecOne[i] = new Vector3d(ptB[i]);

    }
    //vec[0] = new Vector3d(ptA[1]) - new Vector3d(ptB[1]);
    //b.Translate(vec[0]);
    */
    /*for(int i = 0; i < ptA.Count; i++)
    for(int j = 0; j < ptB.Count; j++)
    {

    vec[0] = new Vector3d(ptA[0]) - new Vector3d(ptB[0]);
    b.Translate(vec[0]);

    }
    */

    A = one;

    B = two;

    C = outCurves;

    D = ptA;

    E = ptB;

    F = ptA.Count + ptB.Count;

    AA = ptNFP;

    AB = bin;

    AC = NFPOne;

    /*
    List<Polyline> outCurves = ClipperLib.Clipper.MinkowskiSum(

      u[0].ToPath2D(p, tolerance),
      u[1].ToPath2D(p, tolerance),
      true)
      .Select(path => path.ToPolyline(p, tolerance, true))
      .ToList();

    A = outCurves[0];

    B = pt[z];

    //C = ptO[w];

    AA = planeList;
    */
# ---------- end difference ----------
point_list_4 = PointList(Points=c_script_4.B, Size=Slider(500, range=0..1000))
c_script_5 = CSharpScript(x=curve_8)  # -> out, A, B, C, D, E, F, AA; inputs x: list of Polyline
# ---------- c_script_5: C# ----------
    List<Polyline> poly = x;
    Polyline one = poly[0];
    List<Point3d> pts;
    pts = one.ToList();
    pts.RemoveAt(0);
    Point3d[] poi = pts.ToArray();
    
    Vector3d[] vecOne = new Vector3d[poi.Length];
    
    Polyline two = poly[1];
    List<Point3d> ptsOne;
    ptsOne = two.ToList();
    ptsOne.RemoveAt(0);
    Point3d[] poiOne = ptsOne.ToArray();
    
    Vector3d[] vecTwo = new Vector3d[poiOne.Length];

    A = poi;
    B = vecOne;
    
    C = poiOne;
    D = vecTwo;

    for(int z = 0; z < poi.Length; z++)
    {

      Point3d[] pointOne = shiftLeft(poi);
      vecOne[z] = new Vector3d(pointOne[z]) - new Vector3d(poi[z]);

    }
    
    for(int z = 0; z < poiOne.Length; z++)
    {

      Point3d[] pointOne = shiftLeft(poiOne);
      vecTwo[z] = new Vector3d(pointOne[z]) - new Vector3d(poiOne[z]);

    }
# ---------- c_script_5: C# additional code ----------
  //private Rhino.Display.CustomDisplay m_display = new Rhino.Display.CustomDisplay(true);
  // https://stackoverflow.com/questions/21385066/shifting-array-elements-to-right/21385610#21385610
  // updated so that instead of shifting integers it shifts the Point3d[] list
  public Point3d[] shiftLeft(Point3d[] arr)
  {
    Point3d[] demo = new Point3d[arr.Length];

    for (int i = 0; i < arr.Length - 1; i++)
    {
      demo[i] = arr[i + 1];
    }

    demo[demo.Length - 1] = arr[0];

    return demo;
  }
# ---------- end c_script_5 ----------
curve_12 = Curve(<curve referenced from the Rhino model>)
number_slider_9 = Slider(0, range=0..2)
list_item_27 = ListItem(List=deconstruct_brep.Vertices, Index=0, Wrap=True)
areasorting = CSharpScript(x=curve_9)  # -> out, A, B; inputs x: list of Polyline
# ---------- areasorting: C# ----------
    Polyline[] one = new Polyline[x.Count];
    Curve[] two = new Curve[x.Count];
    double[] areas = new Double[x.Count];
    var curves = new List<KeyValuePair<Curve, double>>();

    for(int i = 0; i < x.Count; ++i)
    {

      one[i] = new Polyline(x[i]);
      two[i] = one[i].ToNurbsCurve();
      areas[i] = AreaMassProperties.Compute(two[i]).Area;
      curves.Add(new KeyValuePair<Curve, double>(two[i], areas[i]));

    }

    curves.Sort(Compare1);
    List<Curve> curve = (from kvp in curves select kvp.Key).Distinct().ToList();
    curve.Reverse();
    A = curve;
# ---------- areasorting: C# additional code ----------
  static int Compare1(KeyValuePair<Curve, double> a, KeyValuePair<Curve, double> b)
  {
    return a.Value.CompareTo(b.Value);
  }
# ---------- end areasorting ----------
sort_list = SortList(Keys=area_2.Area, ValuesValuesA=curve_9)  # -> Keys, ValuesValuesA
discontinuity_3 = Discontinuity(Curve=sort_list.ValuesValuesA, Level=1)  # -> Points, Parameters
number_slider_10 = Slider(200, range=0..1000)
curve_13 = Curve(difference.AC)
A_2 = Curve(difference.A)
deconstruct_brep_2 = DeconstructBrep(Brep=A_2)  # -> Faces, Edges, Vertices
B_2 = Curve(difference.B)
deconstruct_brep_3 = DeconstructBrep(Brep=B_2)  # -> Faces, Edges, Vertices
nfp = Curve(difference.C)
deconstruct_brep_4 = DeconstructBrep(Brep=nfp)  # -> Faces, Edges, Vertices
panel_22 = Panel(c_script_4.B)
number_2 = Number(mass_addition.Result)
curvetopolyline = CSharpScript(x=curve_12, y=Toggle(False))  # -> out, A; inputs x: Curve, y: Boolean
# ---------- curvetopolyline: C# ----------
    if(y == true)
    {

      // Method number One
      Polyline one = new Polyline();
      x.TryGetPolyline(out one);
      List<Point3d> pts = new List<Point3d>();
      pts = one.ToList();

      A = pts;

    }

    else
    {

      // Method number two
      PolylineCurve one = new PolylineCurve();
      one = x.ToPolyline(0, 1, 0.001, 0.0, 0.0, 0.001, 0.0, 0.0, true);

      PolyCurve polyCrv = x as PolyCurve;
      //polyCrv.RemoveNesting();

      //Curve[] oner = polyCrv.Explode();

      A = one;

    }
# ---------- end curvetopolyline ----------
point_16 = Point(difference.D)
partition_list_5 = PartitionList(List=point_16, Size="2")
panel_23 = Panel(partition_list_5)
list_item_28 = ListItem(List=partition_list_5, Index=0, Wrap=True)
list_item_29 = ListItem(List=partition_list_5, Index=1, Wrap=True)
point_list_5 = PointList(Points=point_16, Size=Slider(200, range=0..200))
panel_24 = Panel(difference.F)
reverse_list_2 = ReverseList(List=sort_list.ValuesValuesA)
panel_25 = Panel(difference.AE)
point_17 = Point(c_script_5.A)
vector_2 = Vector(c_script_5.B)
list_length_4 = ListLength(List=deconstruct_brep_3.Vertices)
point_18 = Point(c_script_5.C)
vector_3 = Vector(c_script_5.D)
list_length_5 = ListLength(List=deconstruct_brep_4.Vertices)
deconstruct_brep_5 = DeconstructBrep(Brep=list_item_25)  # -> Faces, Edges, Vertices
minkowski_sum = MinkowskiSum(A=list_item_26, B=list_item_25, Plane=deconstruct_brep_5.Vertices, Tolerance=0.001)  # -> Sum, DisplacedSum
panel_26 = Panel(difference.AD)
partition_list_6 = PartitionList(List=minkowski_sum.Sum, Size=Slider(2, range=0..10))
curve_14 = Curve(areasorting.A)
minkowski_difference = MinkowskiDifference(A=curve_10, B=curve_11, Plane=list_item_27, Tolerance=0.001)
panel_27 = Panel(difference.AF)
c_script_6 = CSharpScript(
    z=number_slider_7,
    Reference=["C:\Program Files\Common Files\McNeel\Rhinoceros\5.0\Plug-ins\ClipperPlugin (bae0724c-d28b-4d54-9b02-806b19d157c2)\0.0.2.1\clipper-0.2.2\ClipperTools.dll", "C:\Users\Paula\AppData\Roaming\Grasshopper\Libraries\PlanktonGh.dll", "C:\Users\Paula\AppData\Roaming\Grasshopper\Libraries\Plankton.dll"])  # -> out, A, B, C, D, E, F, AA; inputs z: Int32, u: list of Polyline
# ---------- c_script_6: C# ----------
    List<Point3d> pt;
    pt = u[0].ToList();

    int[] arr = new int[pt.Count];

    for(int i = 0; i < arr.Length; ++i)
    {

      arr[i] = i;

      Point3d[] array = new Point3d[pt.Count];

      array = pt.ToArray();

      List<Plane> planeList = new List<Plane>();
      for(int x = 0; x < pt.Count; ++x)
      {

        Point3d center = pt[z];
        Vector3d zAxis = Vector3d.ZAxis;
        Plane p = new Rhino.Geometry.Plane(center, zAxis);

        planeList.Add(new Rhino.Geometry.Plane(pt[x], zAxis));

        double tolerance = 0.001;
        List<Polyline> outCurves = ClipperLib.Clipper.MinkowskiSum(

          u[1].ToPath2D(planeList[x], tolerance),
          u[0].ToPath2D(planeList[x], tolerance),
          true)
          .Select(path => path.ToPolyline(planeList[x], tolerance, true))
          .ToList();

        AA = planeList;

        A = outCurves;

        Polyline one = outCurves[0];

        B = one;
        Curve oner = one.ToNurbsCurve();

        C = u[1];
        Curve xer = u[1].ToNurbsCurve();

        D = u[0];

        Rhino.Geometry.Intersect.CurveIntersections ci;
        ci = Rhino.Geometry.Intersect.Intersection.CurveCurve(oner, xer, 0.001, 0.001);
        Point3d[] intPtsO = new Point3d[ci.Count];

        for(int j = 0; j < ci.Count; j++)
        {

          intPtsO[j] = ci[j].PointA;

        }

        E = intPtsO;

        F = intPtsO.Length;

      }

      /*
      Point3d center = pt[z];
      Vector3d zAxis = Vector3d.ZAxis;
      Plane p = new Rhino.Geometry.Plane(center, zAxis);


      double tolerance = 0.001;
      List<Polyline> outCurves = ClipperLib.Clipper.MinkowskiSum(

        u[1].ToPath2D(plarray[i], tolerance),
        u[0].ToPath2D(plarray[i], tolerance),
        true)
        .Select(path => path.ToPolyline(plarray[i], tolerance, true))
        .ToList();

      A = outCurves;

      Polyline one = outCurves[0];

      B = one;
      Curve oner = one.ToNurbsCurve();

      C = u[1];
      Curve xer = u[1].ToNurbsCurve();

      D = u[0];

      AA = plarray[i];


      Rhino.Geometry.Intersect.CurveIntersections ci;
      ci = Rhino.Geometry.Intersect.Intersection.CurveCurve(oner, xer, 0.001, 0.001);
      Point3d[] intPtsO = new Point3d[ci.Count];

      for(int j = 0; j < ci.Count; j++)
      {

        intPtsO[j] = ci[j].PointA;

      }

      E = intPtsO;

      F = intPtsO.Length;
      */

    }
# ---------- end c_script_6 ----------
point_19 = Point(difference.AA)
list_length_6 = ListLength(List=point_16)
point_list_6 = PointList(Points=point_17)
list_item_30 = ListItem(List=partition_list_6, Index=Slider(0, range=0..1), Wrap=True)
point_list_7 = PointList(Points=point_18)
addition = Addition(A=number_2, B=number)
list_item_31 = ListItem(List=deconstruct_brep_3.Vertices, Index=number_slider_9, Wrap=True)
list_item_32 = ListItem(List=deconstruct_brep_2.Vertices, Index=number_slider_8, Wrap=True)
partition_list_7 = PartitionList(List=cull_index_5, Size=Slider(2, range=0..10))  # -> simplify(Chunks)
panel_28 = Panel(sort_list.ValuesValuesA)
addition_2 = Addition(A=list_length_4, B=list_length_5)
list_item_33 = ListItem(List=point_16, Index=0, Wrap=True)
list_item_34 = ListItem(List=curve_14, Index=Slider(0, range=0..10), Wrap=True)
number_slider_11 = Slider(0, range=0..3)
number_slider_12 = Slider(100, range=0..100)
panel_29 = Panel(list_length_6)
panel_30 = Panel(c_script_6.AA)
discontinuity_4 = Discontinuity(Curve=A_2, Level=1)  # -> Points, Parameters
curve_15 = Curve(c_script_6.D)
curve_16 = Curve(c_script_6.B)
curve_17 = Curve(c_script_6.C)
point_20 = Point(c_script_6.E)
integer = Integer(c_script_6.F)
panel_31 = Panel(c_script_6.F)
point_21 = Point(c_script_4.C)
curve_18 = Curve([<curve referenced from the Rhino model> x3])
plane = Plane(c_script_6.AA)
panel_32 = Panel(addition)
panel_33 = Panel(addition_2)
vector_display_13 = VectorDisplay(Anchor=point_17, Vector=vector_2)
vector_display_14 = VectorDisplay(Anchor=point_18, Vector=vector_3)
panel_34 = Panel(deconstruct_brep_3.Vertices)
curve_19 = Curve(<curve referenced from the Rhino model>)
curve_20 = Curve(<curve referenced from the Rhino model>)
point_list_8 = PointList(Points=deconstruct_brep_3.Vertices, Size=Slider(200, range=0..1000))
panel_35 = Panel(c_script_6.out)
curve_21 = Curve(c_script_6.A)
panel_36 = Panel(partition_list_7)
intersection = CSharpScript(x=curve_18)  # -> out, A; inputs x: list of Polyline
# ---------- intersection: C# ----------
    //Curve[] curves = new Curve[x.Count];
    List<Curve> curves = new List<Curve>();
    
    for(int i = 0; i < x.Count; ++i)
    {
    
      //curves[i] = x[i].ToNurbsCurve();
      //curves.Remove(x.Count);
      curves.Add(x[i].ToNurbsCurve());
    
    }
    
    Curve one = curves[x.Count-1];
    
    curves.RemoveAt(x.Count-1);
    
    //A = curves;
    Curve[] two = Curve.CreateBooleanUnion(curves);
    Curve three = two[0];
    A = Curve.CreateBooleanIntersection(three, one);
    //A = two.Length;
# ---------- end intersection ----------
rectangle = Rectangle(Plane=plane, XSize=number_slider_12, YSize=number_slider_12, Radius=0)  # -> Rectangle, Length
tree_branch_2 = TreeBranch(Tree=partition_list_7, Path="{1}", MaintainPaths=True)
tree_branch_3 = TreeBranch(Tree=partition_list_7, Path="{0}", MaintainPaths=True)
deconstruct_brep_6 = DeconstructBrep(Brep=[curve_19, curve_20])  # -> Faces, Edges, flatten(Vertices)
list_item_35 = ListItem(List=deconstruct_brep_5.Vertices, Index=number_slider_7, Wrap=True)
vector_2pt_13 = Vector2Pt(PointA=list_item_28, PointB=list_item_29, Unitize=False)  # -> Vector, Length
panel_37 = Panel(vector_2pt_13.Vector)
lowerleftpoint = CSharpScript(
    x=curve_9,
    y=number_slider_6,
    Reference="C:\PROGRAM FILES\COMMON FILES\MCNEEL\RHINOCEROS\5.0\PLUG-INS\CLIPPERPLUGIN (BAE0724C-D28B-4D54-9B02-806B19D157C2)\0.0.2.1\CLIPPER-0.2.2\ClipperTools.dll")  # -> out, A, B, C; inputs x: list of Polyline, y: Int32
# ---------- lowerleftpoint: C# ----------
    Polyline[] one = new Polyline[x.Count];
    Curve[] two = new Curve[x.Count];
    double[] areas = new Double[x.Count];
    var curves = new List<KeyValuePair<Curve, double>>();

    for(int i = 0; i < x.Count; ++i)
    {

      one[i] = new Polyline(x[i]);
      two[i] = one[i].ToNurbsCurve();
      areas[i] = AreaMassProperties.Compute(two[i]).Area;
      curves.Add(new KeyValuePair<Curve, double>(two[i], areas[i]));

    }

    curves.Sort(Compare1);
    curves.Reverse();
    List<Curve> curve = (from kvp in curves select kvp.Key).Distinct().ToList();
    curve.Reverse();

    Curve[] curvesOne = curve.ToArray();
    Polyline[] poly = new Polyline[curve.Count];
    List<List<Point3d>> pts = new List<List<Point3d>>();
    DataTree<Point3d> tree = new DataTree<Point3d>();
    DataTree<double> treeSum = new DataTree<double>();
    var points = new DataTree<KeyValuePair<Point3d, double>>();
    var point = new List<Point3d>[curve.Count];
    DataTree<Point3d> treeLowerLeft = new DataTree<Point3d>();
    
    for(int i = 0; i < curve.Count; ++i)
    {

      curvesOne[i].TryGetPolyline(out poly[i]);
      pts.Add(poly[i].ToList());
      pts[i].RemoveAt(pts[i].Count - 1);
      GH_Path path = new GH_Path(i);
      
      for(int j = 0; j < pts[i].Count; ++j)
      {

        tree.Add(pts[i][j], path);
        treeSum.Add(pts[i][j].X + pts[i][j].Y, path);
        
        points.Add(new KeyValuePair<Point3d, double>(tree.Branch(i)[j], treeSum.Branch(i)[j]), path);

        points.Branch(i).Sort(Compare2);
        points.Branch(i).Reverse();
        point[i] = (from kvp in points.Branch(i) select kvp.Key).Distinct().ToList();
        point[i].Reverse();  
        
        //p[i] = point[i].ToArray();
        
        //pointArray[i] = tree.Branch(i).ToArray();
        
        //treeLowerLeft.Insert(pointer, path, pts[i].Count);
        
        //treeLowerLeft.Insert(point[i][j], new GH_Path(i, j), point[i].Count);
        
        //treeLowerLeft.Add(point[i][j], path);
        
        //threer.Sort(Compare2);
        //threer.Reverse();
        //List<Point3d> point = (from kvp in threer select kvp.Key).Distinct().ToList();
        //point.Reverse();
        
        //insideDouble.Add(pts[i][j].X + pts[i][j].Y);
        //insidePoint.Add(pts[i][j]);

      }

    }
    
    for(int i = 0; i < tree.BranchCount; ++i)
      for(int j = 0; j < tree.Branch(i).Count; ++j)
      {
      
        treeLowerLeft.Add(point[i][j], new GH_Path(i));
      
      }
    
    /*
    var oner = new List<List<Point3d>>();
    //oner = tree.Branch(0).ToList();

    var twoer = new List<List<double>>();
    //twoer = treeSum.Branch(0).ToList();

    var threer = new List<KeyValuePair<List<Point3d>, List<double>>>();

    for(int i = 0; i < tree.BranchCount; ++i)
      for(int j = 0; j < tree.Branch(i).Count; ++j)
      {

        var onerSize = new List<Point3d>(i);
        onerSize = tree.Branch(i).ToList();
        //oner = tree.Branch(i).ToList();
        oner.Add(onerSize);

        var twoerSize = new List<double>(i);
        twoerSize = treeSum.Branch(i).ToList();
        twoer.Add(twoerSize);

        threer.Add(new KeyValuePair<List<Point3d>, List<double>>(oner[i], twoer[i]));
        //threer.Sort(Compare2);
        //threer.Reverse();
        //List<Point3d> point = (from kvp in threer select kvp.Key).Distinct().ToList();
        //point.Reverse();

        A = threer[1];

      }

    */
    //threer.Add(new KeyValuePair<Point3d, double>(oner[0], twoer[0]));

    /*
    pointsy.Sort(Compare2);
    pointsy.Reverse();
    List<Point3d> point = (from kvp in pointsy select kvp.Key).Distinct().ToList();
    point.Reverse();
    */

    //A = oner;

    //B = poi[1];

    //B = treeSum;
    
    /*
    
    var oner = new DataTree<List<Point3d>>();//tree.Branch(1).ToArray();
    var twoer = new Double[tree.BranchCount][];//treeSum.Branch(1).ToArray();

    for(int i = 0; i < tree.BranchCount; ++i)      
      for(int j = 0; j < tree.Branch(i).Count; ++j)
      {
      
        GH_Path pth = new GH_Path(i);
        oner.Add(tree.Branch(i), pth);
        //oner[i] = tree.Branch(i).ToArray();
        twoer[i] = treeSum.Branch(i).ToArray();
        
      }
    
    */
    
    /*
    var pointArray = new Point3d[tree.BranchCount][];
    var sumArray = new Double[treeSum.BranchCount][];
    var pointDict = new List<KeyValuePair<Point3d, double>>();
    var pointDictate = new List<KeyValuePair<Point3d, double>>[tree.BranchCount];
    var treer = new DataTree<List<KeyValuePair<Point3d, double>>>();

    for(int i = 0; i < tree.BranchCount; ++i)
    {

      pointArray[i] = tree.Branch(i).ToArray();
      sumArray[i] = treeSum.Branch(i).ToArray();
      var pathy = new GH_Path(i);

      for(int j = 0; j < tree.Branch(i).Count; ++j)
      {

        //pointDict.Add(new KeyValuePair<Point3d, double>(pointArray[i][j], sumArray[i][j]));
        pointDict.Add(new KeyValuePair<Point3d, double>(pointArray[i][j], sumArray[i][j]));
        treer.Add(pointDict, pathy);
        pointDictate[i] = new List<KeyValuePair<Point3d, double>>(pointDict);
        //a[i] = new List<int>();

      }

    }
    
    var pointy = new List<Point3d>[pointDictate.Length];
    var treePoint = new List<Point3d>[pointDictate.Length];
    
    for(int i = 0; i < pointDictate.Length; ++i)
    {
    
      //treer.Branch(i).Sort();
      //treer.Branch(i).Reverse();
      pointDictate[i].Sort(Compare2);
      pointDictate[i].Reverse();
      pointy[i] = (from kvp in pointDictate[i] select kvp.Key).Distinct().ToList();
      pointy[i].Reverse();
    
    }
    */
    /*
    pointDict.Sort(Compare2);
    pointDict.Reverse();
    List<Point3d> pointy = (from kvp in pointDict select kvp.Key).Distinct().ToList();
    pointy.Reverse();
    */

    /*
    var threer = new List<KeyValuePair<Point3d, double>>();
    for(int i = 0; i < oner.Length; ++i)
    {

      threer.Add(new KeyValuePair<Point3d, double>(oner[i], twoer[i]));

    }
    threer.Sort(Compare2);
    threer.Reverse();
    List<Point3d> point = (from kvp in threer select kvp.Key).Distinct().ToList();
    point.Reverse();
    
  
    A = point;
    */
    //B = point;
    
    //A = pointArray[1];
    
        A = point[0];
    
    B = treeLowerLeft;
      
    C = tree;
# ---------- lowerleftpoint: C# additional code ----------
  static int Compare1(KeyValuePair<Curve, double> a, KeyValuePair<Curve, double> b)
  {

    return a.Value.CompareTo(b.Value);

  }

  static int Compare2(KeyValuePair<Point3d, double> a, KeyValuePair<Point3d, double> b)
  {

    return a.Value.CompareTo(b.Value);

  }
# ---------- end lowerleftpoint ----------
point_22 = Point(lowerleftpoint.C)
panel_38 = Panel(point_22)
curve_22 = Curve(<curve referenced from the Rhino model>)
deconstruct = Deconstruct(Point=discontinuity_3.Points)  # -> XComponent, YComponent, ZComponent
curve_curve = CurveCurve(CurveA=nfp, CurveB=B_2)  # -> Points, ParamsA, ParamsB
point_23 = Point(curve_curve.Points)
point_24 = Point(lowerleftpoint.A)
galapagos_2 = Galapagos(fitness=c_script_6, gene=number_slider_7)
point_25 = Point(simplify(discontinuity_3.Points))
region_union = RegionUnion(Curves=[curve_19, curve_20])
path_mapper = PathMapper(region_union, source="{A;B}", target="{path_index}")
point_list_9 = PointList(Points=lowerleftpoint.B, Size=number_slider_10)
point_list_10 = PointList(Points=point_24, Size=number_slider_10)
point_list_11 = PointList(Points=lowerleftpoint.C, Size=number_slider_10)
polyline = PolyLine(Vertices=point_17, Closed=Toggle(True))
vector_display_15 = VectorDisplay()
polyline_2 = PolyLine(Vertices=point_18, Closed=Toggle(True))
plane_2 = Plane(list_item_35)
entwine = Entwine(FlattenInputs=True)
panel_39 = Panel(lowerleftpoint.B)
shift_list_2 = ShiftList(List=cull_index_5, Shift=Slider(1, range=0..10), Wrap=True)
panel_40 = Panel(region_union)
vector_display_16 = VectorDisplay(Anchor=list_item_28, Vector=vector_2pt_13.Vector)
panel_41 = Panel(lowerleftpoint.A)
addition_3 = Addition(A=deconstruct.XComponent, B=deconstruct.YComponent)
point_26 = Point(graft(difference.E))
list_length_7 = ListLength(List=point_26)
panel_42 = Panel(list_length_7)
multiplication = Multiplication(A=panel_29, B=panel_42)
point_27 = Point(difference.AA)
sort_list_2 = SortList(Keys=addition_3, ValuesValuesA=point_25)  # -> Keys, ValuesValuesA
point_list_12 = PointList(Points=point_26, Size=Slider(125, range=0..200))
point_list_13 = PointList(Points=point_22, Size=Slider(182, range=0..1000))
graft_tree = GraftTree(Tree=vector_2, IncludeEmptyLists=True, IncludeNullItems=True)
panel_43 = Panel(point_26)
panel_44 = Panel(point_25)
list_item_36 = ListItem(List=nfp, Index=0, Wrap=True)
vector_2pt_14 = Vector2Pt(PointA=point_26, PointB=point_27, Unitize=False)  # -> Vector, Length
list_item_37 = ListItem(List=point_26, Index=0, Wrap=True)
param_viewer = ParamViewer(region_union)
param_viewer_2 = ParamViewer(panel_22)  # disabled
panel_45 = Panel(curve_22)
region_intersection = RegionIntersection(CurvesA=region_union, CurvesB=curve_22)
list_item_38 = ListItem(List=sort_list_2.ValuesValuesA, Index=Slider(0, range=0..100), Wrap=True)  # -> flatten(Item)
minkowski_difference_2 = MinkowskiDifference(A=cull_index_5, B=shift_list_2, Plane=list_item_38, Tolerance=0.001)
panel_46 = Panel(point_27)
list_item_39 = ListItem(List=minkowski_difference_2, Index=0, Wrap=True)
point_list_14 = PointList(Points=sort_list_2.ValuesValuesA, Size=Slider(182, range=0..1000))
panel_48 = Panel(sort_list_2.ValuesValuesA)
evaluate = Evaluate(Expression="If(x=y, True, False)", x=panel_48, y=panel_39)
deconstruct_brep_7 = DeconstructBrep(Brep=list_item_36)  # -> Faces, Edges, Vertices
panel_49 = Panel(region_intersection)
explode_tree_3 = ExplodeTree(Data=vector_2pt_14.Vector)  # -> Branch0, Branch1, Branch2
move = Move(Geometry=B_2, Motion=explode_tree_3.Branch2)  # -> Geometry, Transform
deconstruct_brep_8 = DeconstructBrep(Brep=move.Geometry)  # -> Faces, Edges, Vertices
curve_curve_2 = CurveCurve(CurveA=nfp, CurveB=move.Geometry)  # -> Points, ParamsA, ParamsB
curve_curve_3 = CurveCurve(CurveA=A_2, CurveB=move.Geometry)  # -> Points, ParamsA, ParamsB
list_length_8 = ListLength(List=curve_curve_2.Points)
expression = Expression(x=list_length_8, Expression="If(x>1, True, False)")  # -> flatten(Result)
flatten_tree = FlattenTree(Tree=list_length_8, Path="{0}")
list_length_9 = ListLength(List=curve_curve_3.Points)
addition_4 = Addition(A=list_length_9, B=list_length_8)
panel_50 = Panel(evaluate)
vector_display_17 = VectorDisplay(Anchor=point_26, Vector=vector_2pt_14.Vector)
panel_51 = Panel(list_item_39)
curve_curve_4 = CurveCurve(CurveA=polyline, CurveB=polyline_2)  # -> Points, ParamsA, ParamsB
point_28 = Point(deconstruct_brep_7.Vertices)
panel_52 = Panel(addition_3)
dispatch = Dispatch(List=flatten_tree, DispatchPattern=expression)  # -> Intersect, NoIntersect
panel_53 = Panel(move.Geometry)
cull_index_6 = CullIndex(List=move.Geometry, Indices=Slider(0, range=0..10), Wrap=True)
brep_join = BrepJoin(Breps=[move.Geometry, nfp])  # -> flatten(Breps), Closed
panel_54 = Panel(addition_4)
vector_2pt_15 = Vector2Pt(PointA=curve_curve_4.Points, PointB=point_18, Unitize=False)  # -> Vector, Length
discontinuity_5 = Discontinuity(Curve=cull_index_6, Level=1)  # -> simplify(Points), Parameters
deconstruct_brep_9 = DeconstructBrep(Brep=brep_join.Breps)  # -> Faces, Edges, flatten(Vertices)
point_29 = Point(point_16)
weave = Weave(Pattern=[0, 1], NullGaps=False)
vector_display_18 = VectorDisplay(Anchor=point_18, Vector=vector_2)
number_3 = Number(panel_54)
panel_55 = Panel(vector_2pt_15.Vector)
convex_hull = ConvexHull(Points=flatten([deconstruct_brep_8.Vertices, deconstruct_brep_4.Vertices]), Plane=PlaneXY(0, 0, 0))  # -> Hull, HullZ, Indices
list_length_10 = ListLength(List=point_29)
param_viewer_3 = ParamViewer(discontinuity_5.Points)
panel_56 = Panel("{2}")
number_slider_13 = Slider(6, range=0..6)
bounding_box_3 = BoundingBox(Content=convex_hull.Hull, Plane=PlaneXY(0, 0, 0))  # -> Box, Box_2
area_3 = Area(Geometry=convex_hull.Hull)  # -> Area, Centroid
addition_5 = Addition(A=addition_4, B=area_3.Area)
tree_branch_4 = TreeBranch(Tree=discontinuity_5.Points, Path=number_slider_13, MaintainPaths=True)
list_length_11 = ListLength(List=param_viewer_3)
duplicate_data = DuplicateData(Data=point_29, Number=list_length_11, Order=True)  # -> graft(Data)
panel_57 = Panel("{0,0,0}")
galapagos_3 = Galapagos(fitness=number_3, gene=[number_slider_8, number_slider_9])
panel_58 = Panel(discontinuity_5.Points)
point_30 = Point(tree_branch_4)
merge = Merge(Data1=discontinuity_5.Points, Data2=duplicate_data)
polyline_3 = PolyLine(Vertices=point_30, Closed=True)
merge_2 = Merge(Data1=point_30, Data2=point_29)  # -> flatten(Result)
curve_23 = Curve([<curve referenced from the Rhino model> x2])
convex_hull_2 = ConvexHull(Points=merge_2, Plane=PlaneXY(0, 0, 0))  # -> Hull, HullZ, Indices
c_script_7 = CSharpScript(x=curve_23, Reference="C:\Users\Paula\AppData\Roaming\Grasshopper\Libraries\ClipperTools.dll")  # -> out, A; inputs x: list of Polyline
# ---------- c_script_7: C# ----------
    // Create the data structures and initialize them
    DataTree<Point3d> points = new DataTree<Point3d>();
    List<List<Point3d>> lists = new List<List<Point3d>>(); 
    
    // Fill the nested list with the list of points
    for(int i = 0; i < x.Count; ++i)
    {
    
      lists.Add(x[i].ToList());
    
    }
    
    // Fill the data tree with the list of points
    for(int i = 0; i < lists.Count; ++i)
    {
    
      var path = new GH_Path(i);
      
      for(int j = 0; j < lists[i].Count; ++j )
      {
      
        points.Add(lists[i][j], path);
      
      }
    
    }
    
    // No Fit Polygon One
    Polyline one = x[0];
    Polyline two = x[1];
    
    Point3d center = points.Branch(0).ElementAt(0);
    Vector3d zAxis = Vector3d.ZAxis;
    Plane p = new Rhino.Geometry.Plane(center, zAxis);
    
    double tolerance = 0.001;
    List<Polyline> outCurves = new List<Polyline>();
    List<Polyline> outDisplacedCurves = new List<Polyline>();
    foreach(List<IntPoint> path in ClipperLib.Clipper.MinkowskiDiff(one.ToPath2D(p, tolerance), two.ToPath2D(p, tolerance)))
    {

      Polyline plSum = path.ToPolyline(p, tolerance, true);
      outCurves.Add(plSum);

    }

    Polyline NFP = outCurves[0];

    List<Point3d> ptNFP;
    ptNFP = NFP.ToList();
    ptNFP.RemoveAt(0);
    
    A = NFP;
# ---------- end c_script_7 ----------
area_4 = Area(Geometry=convex_hull_2.Hull)  # -> Area, Centroid
galapagos_4 = Galapagos(fitness=area_4, gene=number_slider_13)
panel_59 = Panel(c_script_7.A)

# ---- group: vectorOrbit / vectorsBClockwise
B_3 = Curve(B_2)
panel_60 = Panel("""a
b
c
d
e
f
g
h
i
j
k
l
m
n
o
p
q
r
s
t
u
v
w
x
y
z""")
deconstruct_brep_10 = DeconstructBrep(Brep=B_3)  # -> Faces, Edges, Vertices
point_on_curve = PointOnCurve(deconstruct_brep_10.Edges, parameter=0.5)
list_length_12 = ListLength(List=deconstruct_brep_10.Edges)
length = Length(Curve=deconstruct_brep_10.Edges)
line_sdl_2 = LineSDL(Start=deconstruct_brep_10.Vertices, Direction=deconstruct_brep_10.Edges, Length=length)
amplitude = Amplitude(Vector=line_sdl_2, Amplitude=length)
vector_display_19 = VectorDisplay(Anchor=deconstruct_brep_10.Vertices, Vector=amplitude)
vector_4 = Vector(graft(line_sdl_2))
path_mapper_2 = PathMapper(vector_4, source="{A;B;C}", target="{A;B;6+C}")

# ---- group: vectorOrbit / verctorsAAnticlockwise
A_3 = Curve(A_2)
deconstruct_brep_11 = DeconstructBrep(Brep=A_3)  # -> Faces, Edges, Vertices
point_on_curve_2 = PointOnCurve(deconstruct_brep_11.Edges, parameter=0.5)
list_length_13 = ListLength(List=deconstruct_brep_11.Edges)
length_2 = Length(Curve=deconstruct_brep_11.Edges)
text_join = TextJoin(Text=panel_60)
sequence = Sequence(Count=list_length_13, CharPool=text_join, Format="{0}")
text_tag_3d = TextTag3D(Location=point_on_curve_2, Text=sequence, Size=Slider(200, range=0..1000), Justification=7)
line_sdl_3 = LineSDL(Start=deconstruct_brep_11.Vertices, Direction=deconstruct_brep_11.Edges, Length=length_2)
vector_display_20 = VectorDisplay(Anchor=deconstruct_brep_11.Vertices, Vector=line_sdl_3)
graft_tree_2 = GraftTree(Tree=sequence, IncludeEmptyLists=True, IncludeNullItems=True)
vector_5 = Vector(graft(line_sdl_3))
path_mapper_3 = PathMapper(graft_tree_2, source="{A;B;C;D}", target="{B;C;D}")

# ---- group: vectorOrbit / vectorsBClockwise (continued)
shift_list_3 = ShiftList(List=panel_60, Shift=list_length_13, Wrap=True)
text_join_2 = TextJoin(Text=shift_list_3)
sequence_2 = Sequence(Count=list_length_12, CharPool=text_join_2, Format="{0}")
text_tag_3d_2 = TextTag3D(Location=point_on_curve, Text=sequence_2, Size=Slider(200, range=0..1000), Justification=7)
graft_tree_3 = GraftTree(Tree=sequence_2, IncludeEmptyLists=True, IncludeNullItems=True)
path_mapper_4 = PathMapper(graft_tree_3, source="{A;B;C;D;E}", target="{C;D;(6+E)}")

# ---- group: vectorOrbit / slopeGraph
merge_3 = Merge(Data1=vector_5, Data2=path_mapper_2)
vector_length = VectorLength(Vector=merge_3)
point_31 = Point(<point referenced from the Rhino model>)
line_sdl_4 = LineSDL(Start=point_31, Direction=merge_3, Length=vector_length)
vector_display_21 = VectorDisplay(Anchor=point_31, Vector=merge_3)
point_on_curve_3 = PointOnCurve(line_sdl_4, parameter=0.464)
merge_4 = Merge(Data1=path_mapper_3, Data2=path_mapper_4)
text_tag_3d_3 = TextTag3D(Location=point_on_curve_3, Text=merge_4, Size=Slider(70, range=0..200), Justification=7)

# ----
vector_6 = Vector(merge_3)
