# Grasshopper definition CSharpWIP.gh (Grasshopper 0.9.76)
# plug-ins: ClipperComponents

format = Format(Culture=127)
number_slider = Slider(2, range=0..10)
number_slider_2 = Slider(1, range=0..1, expression="-x")
curve = Curve([<curve referenced from the Rhino model> x2])
curve_2 = Curve(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)
curve_3 = Curve(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)
number_slider_3 = Slider(9, range=0..19)
number_slider_4 = Slider(17, range=0..19)
number_slider_5 = Slider(180, range=0..360)
discontinuity = Discontinuity(Curve=curve, Level=1)  # -> Points, Parameters
curve_4 = Curve([<curve referenced from the Rhino model> x2])
c_script = CSharpScript(x=curve_4, y=Slider(9, range=0..100), z=Slider(50, range=0..100), u=Slider(100, range=0..100))  # -> out, A, B, C, D, E, F; inputs x: list of Curve, y: Int32, z: Int32, u: Int32
# ---------- c_script: C# ----------
    List<Curve> cur = x;

    Curve c = cur[0];
    Curve cO = cur[1];

    Point3d[] pointsA;
    Point3d[] pointsB;

    if(y == 0 || y == 1)
    {

      y = 2;

    }

    c.DivideByCount(y, true, out pointsA);
    cO.DivideByCount(y, true, out pointsB);

    if(z > y - 1)
    {

      z = y - 1;

    }

    if(z == 0)
    {

      z = 1;

    }

    if(u > y - 1)
    {

      u = y - 1;

    }

    Vector3d referencePoint = new Vector3d(pointsA[0]);
    Vector3d vO = new Vector3d(pointsA[u]);
    Point3d p = new Point3d(pointsB[z]);
    Vector3d vT = new Vector3d(p);

    vT -= vO;
    c.Translate(vT);

    Rhino.Geometry.Intersect.CurveIntersections ci;
    ci = Rhino.Geometry.Intersect.Intersection.CurveCurve(c, cO, 0.001, 0.001);
    Point3d[] intPtsO = new Point3d[ci.Count];

    for(int i = 0; i < ci.Count; i++)
    {

      intPtsO[i] = ci[i].PointA;

    }

    //List<Point3d> pt = new List<Point3d>();

    for( int i = 0; i < y; i++ )
    {

      //pt.Add(pointsA[i]);

      if(ci.Count > 1)
      {

        vO = new Vector3d(intPtsO[0]);
        p = pointsB[i];
        vT = new Vector3d(p);

        vT -= vO;
        c.Translate(vT);

        ci = Rhino.Geometry.Intersect.Intersection.CurveCurve(c, cO, 0.001, 0.001);
        intPtsO = new Rhino.Geometry.Point3d[ci.Count];

        for(int j = 0; j < ci.Count; j++)
        {

          intPtsO[j] = ci[j].PointA;

        }

      }

    }

    A = c;
    B = cO;
    C = p;
    D = intPtsO;
    E = pointsA;
# ---------- end c_script ----------
c_script_2 = CSharpScript(
    A=curve_2,
    B=curve_3,
    x=Slider(20, range=0..50),
    l=Slider(0, range=0..100),
    y=number_slider_3,
    z=number_slider_4,
    u=number_slider_5)  # -> out, AOut, APoints, BPoints, End, CurveA, CurveB, Intersect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; inputs A: Curve, B: Curve, x: Int32, l: Int32, y: Int32, z: Int32, u: Double
# ---------- c_script_2: C# ----------
    Curve a = A;
    Point3d[] pointsA;
    a.DivideByCount(x, true, out pointsA);

    Curve b = B;
    Point3d[] pointsB;
    b.DivideByCount(x, true, out pointsB);

    //End = b.PointAtEnd;


    if(l > x - 1)
    {

      l = (x - 1);
      outs = String.Format("l index is bigger than the size of the x collection");

    }

    /*
    List<Point3d> pointList = new List<Point3d>();
    for( int i = 0; i < pointsA.Length; i++ )
    {
      pointList.Add(pointsA[i]);
    }
    //foreach(Point3d point in pointList){}
    */

    Vector3d vec = new Vector3d(pointsB[l]);
    Vector3d one = new Vector3d(a.PointAtEnd);
    vec -= one;

    a.Translate(vec);

    CurveA = a;
    CurveB = b;

    Rhino.Geometry.Intersect.CurveIntersections ci;
    ci = Rhino.Geometry.Intersect.Intersection.CurveCurve(a, b, 0.001, 0.001);
    Point3d[] intPts = new Rhino.Geometry.Point3d[ci.Count];

    Point3d[] ptsA;
    a.DivideByCount(x, true, out ptsA);
    two = ptsA;

    End = a.PointAtEnd;

    for(int i = 0; i < ci.Count; i++)
    {

      intPts[i] = ci[i].PointA;

    }
    Intersect = intPts;

    if(ci.Count > 1)
    {


      Vector3d vO = new Vector3d(ptsA[z]);
      three = vO;
      Vector3d vT = new Vector3d(pointsB[y]);
      three = vT;
      vT -= vO;
      a.Translate(vT);

      /*
      Random r = new Random();
      foreach (int i in Enumerable.Range(0, 9).OrderBy(t => r.Next()))
      {
        four = i;
      }
      */

      /*
      List<Vector3d> pAList = new List<Vector3d>();
      Vector3d pA;
      List<Vector3d> pBList = new List<Vector3d>();
      Vector3d pB;
      */
      /*
      for(int i = 0; i < x; ++i)
      {

        //Vector3d[] p = new Vector3d[](ptsA[i]);
        //Vector3d[] pO = new Vector3d[](pointsB[j]);
        //p -= pO;
        //three = p;
        //a.Translate(p[1]);
        pA = new Vector3d(ptsA[i]);
        pB = new Vector3d(pointsB[i]);
        pAList.Add(pA);
        pBList.Add(pB);
        three = pAList;
        four = pBList;

      }
      */

      //a.Rotate(u * (Math.PI / 180), Vector3d.ZAxis, pointsB[y]);

      Rhino.Geometry.Intersect.CurveIntersections c;
      c = Rhino.Geometry.Intersect.Intersection.CurveCurve(a, b, 0.001, 0.001);
      Point3d[] intPtsO = new Rhino.Geometry.Point3d[c.Count];

      for(int i = 0; i < c.Count; i++)
      {

        intPtsO[i] = c[i].PointA;

      }
      IntersectTwo = intPtsO;
      four = c.Count;

      //Point3d p = new Point3d(ci[0].PointA);

      //Vector3d v = new Vector3d(p);

      /*
      Vector3d vO = new Vector3d(pointsA[l]);
      vec += vO;
      a.Translate(vec);
      */

      //Transform trans = Transform.Rotation(u, vec, ci[0].PointA);

      outs = String.Format("More than one collision");
      //oner = v;

    }

    else if( ci.Count == 1 )
    {

      outs = String.Format("Only one collision");

    }

    APoints = pointsA;
    BPoints = pointsB;
    AOut = String.Format(a + "\n" + b);
    //End = Counter();
# ---------- c_script_2: C# additional code ----------
  public Point3d Counter()
  {

    Point3d pt = new Point3d(1, 1, 1);
    return pt;

  }
# ---------- end c_script_2 ----------
c_script_3 = CSharpScript(x=curve, y=Slider(65.184, range=0..100), z=Slider(3, range=0..5))  # -> out, A, B, C, D, E; inputs x: list of Polyline, y: Double, z: Int32
# ---------- c_script_3: C# ----------
    List<Polyline> poly = x;

    var ptsA = new List<Point3d>();
    Polyline one = poly[1];
    ptsA = one.ToList();
    A = ptsA;

    var ptsB = new List<Point3d>();
    Polyline two = poly[0];
    ptsB = two.ToList();
    B = ptsB;

    Point3d ptA = ptsA[0];
    Point3d ptB = ptsB[z];

    Curve oneN = one.ToNurbsCurve();
    Vector3d vecA = new Vector3d(ptA);
    Vector3d vecB = new Vector3d(ptB);
    Vector3d fin = vecB - vecA;
    oneN.Translate(fin);
    C = oneN;

    Curve twoN = two.ToNurbsCurve();

    Rhino.Geometry.Intersect.CurveIntersections ci;
    ci = Rhino.Geometry.Intersect.Intersection.CurveCurve(oneN, twoN, 0.001, 0.001);
    Point3d[] intPtsO = new Rhino.Geometry.Point3d[ci.Count];

    for(int i = 0; i < ci.Count; i++)
    {

      intPtsO[i] = ci[i].PointA;

    }

    D = intPtsO;

    if(ci.Count > 1)
    {

      //oneN.DivideByCount();

      /*ptA = ptsA[1];
      vecA = new Vector3d(ptA);
      fin = vecB - vecA;
      oneN.Translate(fin);
      C = oneN;
      E = fin;
      */
    }
# ---------- end c_script_3 ----------
panel = Panel(c_script.F)
point = Point(c_script_3.A)
cull_index = CullIndex(List=point, Indices=number_slider_2, Wrap=True)
point_list = PointList(Points=cull_index)
panel_2 = Panel(cull_index)
partition_list = PartitionList(List=panel_2, Size=number_slider)  # -> simplify(Chunks)
partition_list_2 = PartitionList(List=panel_2, Size=number_slider)  # -> reverse(simplify(Chunks))
partition_list_3 = PartitionList(List=panel_2, Size=Slider(2, range=0..10))  # -> simplify(Chunks)
split_list = SplitList(List=cull_index, Index=Slider(2, range=0..10))  # -> ListA, ListB
panel_3 = Panel(partition_list)
explode_tree = ExplodeTree(Data=panel_3)  # -> Branch0, Branch1
panel_4 = Panel(partition_list_2)
explode_tree_2 = ExplodeTree(Data=panel_4)  # -> Branch0, Branch1
point_2 = Point(split_list.ListB)
point_3 = Point(split_list.ListA)
panel_5 = Panel(partition_list_3)
list_item = ListItem(List=explode_tree_2.Branch0, Index=Slider(1, range=0..100), Wrap=True)
list_item_2 = ListItem(List=partition_list_3, Index=Slider(0, range=0..100), Wrap=True)
list_item_3 = ListItem(List=explode_tree.Branch0, Index=Slider(1, range=0..100), Wrap=True)
list_item_4 = ListItem(List=explode_tree_2.Branch1, Index=Slider(0, range=0..1), Wrap=True)
list_item_5 = ListItem(List=partition_list_3, Index=Slider(1, range=0..1), Wrap=True)
list_item_6 = ListItem(List=explode_tree.Branch1, Index=Slider(0, range=0..1), Wrap=True)
list_item_7 = ListItem(List=split_list.ListA, Index=Slider(0, range=0..1), Wrap=True)
list_item_8 = ListItem(List=explode_tree_2.Branch0, Index=Slider(0, range=0..100), Wrap=True)
list_item_9 = ListItem(List=split_list.ListA, Index=Slider(1, range=0..1), Wrap=True)
list_item_10 = ListItem(List=split_list.ListB, Index=Slider(1, range=0..1), Wrap=True)
list_item_11 = ListItem(List=split_list.ListB, Index=Slider(0, range=0..1), Wrap=True)
list_item_12 = ListItem(List=explode_tree_2.Branch1, Index=Slider(1, range=0..1), Wrap=True)
panel_6 = Panel(point)
point_4 = Point(list_item_2)
point_5 = Point(list_item_5)
point_6 = Point(list_item)
point_7 = Point(list_item_4)
point_8 = Point(list_item_6)
point_9 = Point(list_item_3)
point_10 = Point(list_item_8)
point_11 = Point(list_item_12)
vector_2pt = Vector2Pt(PointA=list_item_10, PointB=list_item_7, Unitize=False)  # -> Vector, Length
vector_2pt_2 = Vector2Pt(PointA=list_item_9, PointB=list_item_11, Unitize=False)  # -> Vector, Length
vector_2pt_3 = Vector2Pt(PointA=list_item_2, PointB=list_item_5, Unitize=False)  # -> Vector, Length
vector_2pt_4 = Vector2Pt(PointA=list_item_4, PointB=list_item, Unitize=False)  # -> Vector, Length
vector_2pt_5 = Vector2Pt(PointA=list_item_3, PointB=list_item_6, Unitize=False)  # -> Vector, Length
vector_2pt_6 = Vector2Pt(PointA=list_item_12, PointB=list_item_8, Unitize=False)  # -> Vector, Length
shift_list = ShiftList(List=panel_5, Shift=number_slider_2, Wrap=False)
vector_display = VectorDisplay(Anchor=list_item_10, Vector=vector_2pt.Vector)
vector_display_2 = VectorDisplay(Anchor=list_item_9, Vector=vector_2pt_2.Vector)
vector_display_3 = VectorDisplay(Anchor=list_item_2, Vector=vector_2pt_3.Vector)
vector_display_4 = VectorDisplay(Anchor=list_item_4, Vector=vector_2pt_4.Vector)
vector_display_5 = VectorDisplay(Anchor=list_item_3, Vector=vector_2pt_5.Vector)
vector_display_6 = VectorDisplay(Anchor=list_item_12, Vector=vector_2pt_6.Vector)
panel_8 = Panel(shift_list)
point_12 = Point(c_script_3.B)
list_length = ListLength(List=point_12)
panel_9 = Panel(list_length)
list_item_13 = ListItem(List=point_12, Index=Slider(0, range=0..7), Wrap=True)
list_item_14 = ListItem(List=point_12, Index=Slider(1, range=0..7), Wrap=True)
list_item_15 = ListItem(List=point_12, Index=Slider(2, range=0..7), Wrap=True)
list_item_16 = ListItem(List=point_12, Index=Slider(1, range=0..7), Wrap=True)
list_item_17 = ListItem(List=point_12, Index=Slider(3, range=0..7), Wrap=True)
list_item_18 = ListItem(List=point_12, Index=Slider(2, range=0..7), Wrap=True)
list_item_19 = ListItem(List=point_12, Index=Slider(3, range=0..7), Wrap=True)
list_item_20 = ListItem(List=point_12, Index=Slider(4, range=0..7), Wrap=True)
list_item_21 = ListItem(List=point_12, Index=Slider(5, range=0..7), Wrap=True)
list_item_22 = ListItem(List=point_12, Index=Slider(4, range=0..7), Wrap=True)
list_item_23 = ListItem(List=point_12, Index=Slider(5, range=0..7), Wrap=True)
list_item_24 = ListItem(List=point_12, Index=Slider(6, range=0..7), Wrap=True)
curve_5 = Curve(c_script_3.C)
point_13 = Point(c_script_3.D)
point_14 = Point(c_script_3.E)
aoriginalpoints = Point(c_script_2.APoints)
boriginalpoints = Point(c_script_2.BPoints)
intersecttwo = Point(c_script_2.IntersectTwo)
intersectone = Point(c_script_2.Intersect)
pointanew = Point(c_script_2.two)
endpoints = Point(c_script_2.End)
curvea = Curve(c_script_2.CurveA)
panel_10 = Panel(c_script_2.oner)
curveb = Curve(c_script_2.CurveB)
point_15 = Point(c_script_2.three)
panel_11 = Panel(c_script_2.outs)
vector_2pt_7 = Vector2Pt(PointA=list_item_13, PointB=list_item_14, Unitize=False)  # -> Vector, Length
vector_2pt_8 = Vector2Pt(PointA=list_item_15, PointB=list_item_17, Unitize=False)  # -> Vector, Length
vector_2pt_9 = Vector2Pt(PointA=list_item_16, PointB=list_item_18, Unitize=False)  # -> Vector, Length
vector_2pt_10 = Vector2Pt(PointA=list_item_19, PointB=list_item_22, Unitize=False)  # -> Vector, Length
vector_2pt_11 = Vector2Pt(PointA=list_item_20, PointB=list_item_23, Unitize=False)  # -> Vector, Length
vector_2pt_12 = Vector2Pt(PointA=list_item_21, PointB=list_item_24, Unitize=False)  # -> Vector, Length
vector = Vector(c_script_2.oner)
panel_12 = Panel(endpoints)
panel_13 = Panel(intersectone)
panel_14 = Panel(intersecttwo)
panel_15 = Panel(pointanew)
panel_16 = Panel(c_script_2.three)
panel_17 = Panel(c_script_2.four)
A = Curve(c_script.A)
B = Curve(c_script.B)
C = Point(c_script.C)
D = Point(c_script.D)
E = Point(c_script.E)
partition_list_4 = PartitionList(List=point, Size="4")
panel_18 = Panel(partition_list_4)
vector_display_7 = VectorDisplay(Anchor=list_item_13, Vector=vector_2pt_7.Vector)
vector_display_8 = VectorDisplay(Anchor=list_item_15, Vector=vector_2pt_8.Vector)
vector_display_9 = VectorDisplay(Anchor=list_item_16, Vector=vector_2pt_9.Vector)
vector_display_10 = VectorDisplay(Anchor=list_item_19, Vector=vector_2pt_10.Vector)
vector_display_11 = VectorDisplay(Anchor=list_item_20, Vector=vector_2pt_11.Vector)
vector_display_12 = VectorDisplay(Anchor=list_item_21, Vector=vector_2pt_12.Vector)
point_list_2 = PointList(Points=point, Size=Slider(95.76, range=0..200))
bounding_box = BoundingBox(Content=curveb, Plane=PlaneXY(0, 0, 0))  # -> Box, Box_2
bounding_box_2 = BoundingBox(Content=curvea, Plane=PlaneXY(0, 0, 0))  # -> Box, Box_2
brep = Brep(curveb)
brep_2 = Brep(curvea)
number = Number(panel_17)
galapagos = Galapagos(fitness=addition, gene=[number_slider_3, number_slider_4, number_slider_5])
tree_branch = TreeBranch(Tree=partition_list_4, Path="{0;0;0}", MaintainPaths=True)
reverse_list = ReverseList(List=tree_branch)
panel_19 = Panel(reverse_list)
divide_curve = DivideCurve(Curve=curvea, Count=Slider(40, range=0..100), Kinks=False)  # -> Points, Tangents, Parameters
perp_frame = PerpFrame(Curve=curvea, Parameter=divide_curve.Parameters)
deconstruct_plane = DeconstructPlane(Plane=perp_frame)  # -> Origin, XAxis, YAxis, ZAxis
area = Area(Geometry=[bounding_box.Box, bounding_box_2.Box])  # -> Area, Centroid
curve_6 = Curve([<curve referenced from the Rhino model> x2])
curve_7 = Curve([<curve referenced from the Rhino model> x2])
curve_8 = Curve([<curve referenced from the Rhino model> x2])
curve_9 = Curve([<curve referenced from the Rhino model> x2])
curve_10 = Curve([<curve referenced from the Rhino model> x2])
curve_11 = Curve([<curve referenced from the Rhino model> x2])
curve_12 = Curve([<curve referenced from the Rhino model> x2])
line_sdl = LineSDL(Start=perp_frame, Direction=deconstruct_plane.YAxis, Length=Slider(100, range=0..100))
list_item_25 = ListItem(List=curve_12, Index=Slider(0, range=0..1), Wrap=True)
list_item_26 = ListItem(List=curve_12, Index=Slider(1, range=0..1), Wrap=True)
number_slider_6 = Slider(2, range=0..4)
mass_addition = MassAddition(Input=area.Area)  # -> Result, PartialResults
c_script_4 = CSharpScript(
    z=Slider(2, range=0..10),
    u=curve_7,
    w=Slider(2, range=0..10),
    Reference=["C:\Users\Paula\AppData\Roaming\Grasshopper\Libraries\ClipperTools.dll", "C:\Users\Paula\AppData\Roaming\Grasshopper\Libraries\PlanktonGh.dll", "C:\Users\Paula\AppData\Roaming\Grasshopper\Libraries\Plankton.dll"])  # -> out, A, B, C, D, E, F, AA; inputs z: Int32, u: list of Polyline, w: Int32
# ---------- c_script_4: C# ----------
    List<Point3d> pt;
    pt = u[0].ToList();

    List<Point3d> ptO;
    ptO = u[1].ToList();

    int[] arr = new int[pt.Count];

    for(int i = 0; i < arr.Length; ++i)
    {

      arr[i] = i;

      Point3d[] array = new Point3d[pt.Count];

      array = pt.ToArray();

      List<Plane> planeList = new List<Plane>();
      for(int x = 0; x < pt.Count; ++x)
      {

        Point3d center = pt[z];
        Point3d centerOne = ptO[w];
        Vector3d zAxis = Vector3d.ZAxis;
        Plane p = new Rhino.Geometry.Plane(center, zAxis);
        Plane pO = new Rhino.Geometry.Plane();

        //planeList.Add(new Rhino.Geometry.Plane(pt[x], zAxis));

        double tolerance = 0.001;
        List<Polyline> outCurves = ClipperLib.Clipper.MinkowskiSum(

          u[0].ToPath2D(p, tolerance),
          u[1].ToPath2D(p, tolerance),
          true)
          .Select(path => path.ToPolyline(p, tolerance, true))
          .ToList();

        A = outCurves[0];

        B = pt[z];

        //C = ptO[w];

        AA = planeList;

      }

    }
# ---------- end c_script_4 ----------
c_script_5 = CSharpScript(
    z=number_slider_6,
    u=curve_9,
    Reference=["C:\Users\Paula\AppData\Roaming\Grasshopper\Libraries\ClipperTools.dll", "C:\Users\Paula\AppData\Roaming\Grasshopper\Libraries\PlanktonGh.dll", "C:\Users\Paula\AppData\Roaming\Grasshopper\Libraries\Plankton.dll"])  # -> out, A, B, C, D, E, F, AA; inputs z: Int32, u: list of Polyline
# ---------- c_script_5: C# ----------
    List<Point3d> pt;
    pt = u[0].ToList();

    int[] arr = new int[pt.Count];

    for(int i = 0; i < arr.Length; ++i)
    {

      arr[i] = i;

      Point3d[] array = new Point3d[pt.Count];

      array = pt.ToArray();

      List<Plane> planeList = new List<Plane>();
      for(int x = 0; x < pt.Count; ++x)
      {

        Point3d center = pt[x];
        Vector3d zAxis = Vector3d.ZAxis;
        Plane p = new Rhino.Geometry.Plane(center, zAxis);

        //planeList.Add(new Rhino.Geometry.Plane(pt[x], zAxis));

        double tolerance = 0.001;
        List<Polyline> outCurves = ClipperLib.Clipper.MinkowskiSum(

          u[1].ToPath2D(p, tolerance),
          u[0].ToPath2D(p, tolerance),
          true)
          .Select(path => path.ToPolyline(p, tolerance, true))
          .ToList();

        A = outCurves[0];

        B = center;
        
        AA = planeList;

      }

    }
# ---------- end c_script_5 ----------
c_script_6 = CSharpScript(x=curve_6)  # -> out, A, B, C, D, E, F, AA; inputs x: list of Polyline
# ---------- c_script_6: C# ----------
    List<Polyline> poly = x;
    Polyline one = poly[0];
    List<Point3d> pts;
    pts = one.ToList();
    pts.RemoveAt(0);
    Point3d[] poi = pts.ToArray();
    
    Vector3d[] vecOne = new Vector3d[poi.Length];
    
    Polyline two = poly[1];
    List<Point3d> ptsOne;
    ptsOne = two.ToList();
    ptsOne.RemoveAt(0);
    Point3d[] poiOne = ptsOne.ToArray();
    
    Vector3d[] vecTwo = new Vector3d[poiOne.Length];

    A = poi;
    B = vecOne;
    
    C = poiOne;
    D = vecTwo;

    for(int z = 0; z < poi.Length; z++)
    {

      Point3d[] pointOne = shiftLeft(poi);
      vecOne[z] = new Vector3d(pointOne[z]) - new Vector3d(poi[z]);

    }
    
    for(int z = 0; z < poiOne.Length; z++)
    {

      Point3d[] pointOne = shiftLeft(poiOne);
      vecTwo[z] = new Vector3d(pointOne[z]) - new Vector3d(poiOne[z]);

    }
# ---------- c_script_6: C# additional code ----------
  //private Rhino.Display.CustomDisplay m_display = new Rhino.Display.CustomDisplay(true);
  // https://stackoverflow.com/questions/21385066/shifting-array-elements-to-right/21385610#21385610
  // updated so that instead of shifting integers it shifts the Point3d[] list
  public Point3d[] shiftLeft(Point3d[] arr)
  {
    Point3d[] demo = new Point3d[arr.Length];

    for (int i = 0; i < arr.Length - 1; i++)
    {
      demo[i] = arr[i + 1];
    }

    demo[demo.Length - 1] = arr[0];

    return demo;
  }
# ---------- end c_script_6 ----------
c_script_7 = CSharpScript(
    z=number_slider_6,
    u=curve_10,
    Reference=["C:\Users\Paula\AppData\Roaming\Grasshopper\Libraries\ClipperTools.dll", "C:\Users\Paula\AppData\Roaming\Grasshopper\Libraries\PlanktonGh.dll", "C:\Users\Paula\AppData\Roaming\Grasshopper\Libraries\Plankton.dll"])  # -> out, A, B, C, D, E, F, AA; inputs z: Int32, u: list of Polyline
# ---------- c_script_7: C# ----------
    List<Point3d> pt;
    pt = u[1].ToList();

    int[] arr = new int[pt.Count];

    for(int i = 0; i < arr.Length; ++i)
    {

      arr[i] = i;

      Point3d[] array = new Point3d[pt.Count];

      array = pt.ToArray();

      List<Plane> planeList = new List<Plane>();
      for(int x = 0; x < pt.Count; ++x)
      {

        Point3d center = pt[x];
        Vector3d zAxis = Vector3d.ZAxis;
        Plane p = new Rhino.Geometry.Plane(center, zAxis);

        //planeList.Add(new Rhino.Geometry.Plane(pt[x], zAxis));

        double tolerance = 0.001;
        List<Polyline> outCurves = ClipperLib.Clipper.MinkowskiSum(

          u[1].ToPath2D(p, tolerance),
          u[0].ToPath2D(p, tolerance),
          true)
          .Select(path => path.ToPolyline(p, tolerance, true))
          .ToList();

        A = outCurves[0];

        AA = planeList;

      }

    }
# ---------- end c_script_7 ----------
c_script_8 = CSharpScript(
    z=number_slider_6,
    u=curve_8,
    Reference=["C:\Users\Paula\AppData\Roaming\Grasshopper\Libraries\ClipperTools.dll", "C:\Users\Paula\AppData\Roaming\Grasshopper\Libraries\PlanktonGh.dll", "C:\Users\Paula\AppData\Roaming\Grasshopper\Libraries\Plankton.dll"])  # -> out, A, B, C, D, E, F, AA; inputs z: Int32, u: list of Polyline
# ---------- c_script_8: C# ----------
    List<Point3d> pt;
    pt = u[0].ToList();

    int[] arr = new int[pt.Count];

    for(int i = 0; i < arr.Length; ++i)
    {

      arr[i] = i;

      Point3d[] array = new Point3d[pt.Count];

      array = pt.ToArray();

      List<Plane> planeList = new List<Plane>();
      for(int x = 0; x < pt.Count; ++x)
      {

        Point3d center = pt[x];
        Vector3d zAxis = Vector3d.ZAxis;
        Plane p = new Rhino.Geometry.Plane(center, zAxis);

        //planeList.Add(new Rhino.Geometry.Plane(pt[x], zAxis));

        double tolerance = 0.001;
        List<Polyline> outCurves = ClipperLib.Clipper.MinkowskiSum(

          u[1].ToPath2D(p, tolerance),
          u[0].ToPath2D(p, tolerance),
          true)
          .Select(path => path.ToPolyline(p, tolerance, true))
          .ToList();

        A = outCurves[0];

        AA = planeList;

      }

    }
# ---------- end c_script_8 ----------
c_script_9 = CSharpScript(
    z=number_slider_6,
    u=curve_11,
    Reference=["C:\Users\Paula\AppData\Roaming\Grasshopper\Libraries\ClipperTools.dll", "C:\Users\Paula\AppData\Roaming\Grasshopper\Libraries\PlanktonGh.dll", "C:\Users\Paula\AppData\Roaming\Grasshopper\Libraries\Plankton.dll"])  # -> out, A, B, C, D, E, F, AA; inputs z: Int32, u: list of Polyline; same code as c_script_8
c_script_10 = CSharpScript(
    z=number_slider_6,
    u=curve_6,
    Reference=["C:\Users\Paula\AppData\Roaming\Grasshopper\Libraries\ClipperTools.dll", "C:\Users\Paula\AppData\Roaming\Grasshopper\Libraries\PlanktonGh.dll", "C:\Users\Paula\AppData\Roaming\Grasshopper\Libraries\Plankton.dll"])  # -> out, A, B, C, D, E, F, AA; inputs z: Int32, u: list of Polyline; same code as c_script_8
number_2 = Number(mass_addition.Result)
point_16 = Point(c_script_6.A)
vector_2 = Vector(c_script_6.B)
point_17 = Point(c_script_6.C)
vector_3 = Vector(c_script_6.D)
deconstruct_brep = DeconstructBrep(Brep=list_item_25)  # -> Faces, Edges, Vertices
minkowski_sum = MinkowskiSum(A=list_item_26, B=list_item_25, Plane=deconstruct_brep.Vertices, Tolerance=0.001)  # -> Sum, DisplacedSum
partition_list_5 = PartitionList(List=minkowski_sum.Sum, Size=Slider(2, range=0..10))
c_script_11 = CSharpScript(
    z=number_slider_6,
    u=curve_6,
    Reference=["C:\Users\Paula\AppData\Roaming\Grasshopper\Libraries\ClipperTools.dll", "C:\Users\Paula\AppData\Roaming\Grasshopper\Libraries\PlanktonGh.dll", "C:\Users\Paula\AppData\Roaming\Grasshopper\Libraries\Plankton.dll"])  # -> out, A, B, C, D, E, F, AA; inputs z: Int32, u: list of Polyline
# ---------- c_script_11: C# ----------
    List<Point3d> pt;
    pt = u[0].ToList();

    int[] arr = new int[pt.Count];

    for(int i = 0; i < arr.Length; ++i)
    {

      arr[i] = i;

      Point3d[] array = new Point3d[pt.Count];

      array = pt.ToArray();

      List<Plane> planeList = new List<Plane>();
      for(int x = 0; x < pt.Count; ++x)
      {

        Point3d center = pt[z];
        Vector3d zAxis = Vector3d.ZAxis;
        Plane p = new Rhino.Geometry.Plane(center, zAxis);

        planeList.Add(new Rhino.Geometry.Plane(pt[x], zAxis));

        double tolerance = 0.001;
        List<Polyline> outCurves = ClipperLib.Clipper.MinkowskiSum(

          u[1].ToPath2D(planeList[x], tolerance),
          u[0].ToPath2D(planeList[x], tolerance),
          true)
          .Select(path => path.ToPolyline(planeList[x], tolerance, true))
          .ToList();

        AA = planeList;

        A = outCurves;

        Polyline one = outCurves[0];

        B = one;
        Curve oner = one.ToNurbsCurve();

        C = u[1];
        Curve xer = u[1].ToNurbsCurve();

        D = u[0];

        Rhino.Geometry.Intersect.CurveIntersections ci;
        ci = Rhino.Geometry.Intersect.Intersection.CurveCurve(oner, xer, 0.001, 0.001);
        Point3d[] intPtsO = new Point3d[ci.Count];

        for(int j = 0; j < ci.Count; j++)
        {

          intPtsO[j] = ci[j].PointA;

        }

        E = intPtsO;

        F = intPtsO.Length;

      }

      /*
      Point3d center = pt[z];
      Vector3d zAxis = Vector3d.ZAxis;
      Plane p = new Rhino.Geometry.Plane(center, zAxis);


      double tolerance = 0.001;
      List<Polyline> outCurves = ClipperLib.Clipper.MinkowskiSum(

        u[1].ToPath2D(plarray[i], tolerance),
        u[0].ToPath2D(plarray[i], tolerance),
        true)
        .Select(path => path.ToPolyline(plarray[i], tolerance, true))
        .ToList();

      A = outCurves;

      Polyline one = outCurves[0];

      B = one;
      Curve oner = one.ToNurbsCurve();

      C = u[1];
      Curve xer = u[1].ToNurbsCurve();

      D = u[0];

      AA = plarray[i];


      Rhino.Geometry.Intersect.CurveIntersections ci;
      ci = Rhino.Geometry.Intersect.Intersection.CurveCurve(oner, xer, 0.001, 0.001);
      Point3d[] intPtsO = new Point3d[ci.Count];

      for(int j = 0; j < ci.Count; j++)
      {

        intPtsO[j] = ci[j].PointA;

      }

      E = intPtsO;

      F = intPtsO.Length;
      */

    }
# ---------- end c_script_11 ----------
point_list_3 = PointList(Points=point_16)
list_item_27 = ListItem(List=partition_list_5, Index=Slider(0, range=0..1), Wrap=True)
point_list_4 = PointList(Points=point_17)
addition = Addition(A=number_2, B=number)
number_slider_7 = Slider(0, range=0..3)
number_slider_8 = Slider(100, range=0..100)
panel_20 = Panel(c_script_11.AA)
curve_13 = Curve(c_script_11.B)
curve_14 = Curve(c_script_11.C)
curve_15 = Curve(c_script_11.D)
point_18 = Point(c_script_11.E)
integer = Integer(c_script_11.F)
panel_21 = Panel(c_script_11.F)
vector_display_13 = VectorDisplay(Anchor=point_16, Vector=vector_2)
vector_display_14 = VectorDisplay(Anchor=point_17, Vector=vector_3)
plane = Plane(c_script_11.AA)
panel_22 = Panel(addition)
panel_23 = Panel(c_script_11.out)
curve_16 = Curve(c_script_11.A)
rectangle = Rectangle(Plane=plane, XSize=number_slider_8, YSize=number_slider_8, Radius=0)  # -> Rectangle, Length
list_item_28 = ListItem(List=deconstruct_brep.Vertices, Index=number_slider_6, Wrap=True)
galapagos_2 = Galapagos(fitness=c_script_11, gene=number_slider_6)
plane_2 = Plane(list_item_28)
