# Grasshopper definition alpha_shapes.gh (Grasshopper 0.9.76)
# plug-ins: AlphaShape

pt = Point([<point referenced from the Rhino model> x7])
srf = Surface(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)
crv = Curve([<curve referenced from the Rhino model> x6])
popgeo = PopulateGeometry(Geometry=srf, Count=100, Seed=1)
divide = DivideCurve(Curve=crv, Count=50, Kinks=False)  # -> flatten(Points), Tangents, Parameters
del = DelaunayMesh(Points=divide.Points, Plane=PlaneXY(0, 0, 0))
disc = Discontinuity(Curve=crv, Level=1)  # -> flatten(Points), Parameters
weld = WeldMesh(Mesh=del, Angle=3.141592654)
number_slider = Slider(8, range=0..10)
attrition = Slider(0.7, range=0..1)
facec = FaceCircles(Mesh=weld)  # -> Centers, Ratio
test = AlphaShapeFromDelaunay(Mesh=weld)
demesh = DeconstructMesh(Mesh=weld)  # -> Vertices, Faces, Colours, Normals
darc = DeconstructArc(Arc=facec.Centers)  # -> BasePlane, Radius, Angle
c_script = CSharpScript(
    x=divide.Points,
    y=attrition,
    Reference=["C:\Program Files\Common Files\McNeel\Rhinoceros\5.0\Plug-ins\Grasshopper (b45a29b1-4343-4035-989e-044e8580d9cf)\0.9.76.0\Components\Surface.gha", "C:\Program Files\Common Files\McNeel\Rhinoceros\5.0\Plug-ins\Grasshopper (b45a29b1-4343-4035-989e-044e8580d9cf)\0.9.76.0\Components\Curve.gha"])  # -> out, A; inputs x: list of Point3d, y: Double
# ---------- c_script: C# ----------
    var nodeTwoList = new Grasshopper.Kernel.Geometry.Node2List(x);
    var delaunayFaces = Grasshopper.Kernel.Geometry.Delaunay.Solver.Solve_Faces(nodeTwoList, 1);
    var delaunayMesh = Grasshopper.Kernel.Geometry.Delaunay.Solver.Solve_Mesh(nodeTwoList, 1, ref delaunayFaces);
    delaunayMesh.Weld(Math.PI);

    var list = new System.Collections.Generic.List<object>();

    var circles = new SurfaceComponents.MeshComponents.Component_MeshFaceCircles();
    var param = circles.Params.Input[0] as Grasshopper.Kernel.GH_PersistentGeometryParam<Grasshopper.Kernel.Types.GH_Mesh>;
    param.PersistentData.ClearData();
    param.PersistentData.Append(new GH_Mesh(delaunayMesh));

    circles.ExpireSolution(true);

    //add to a dummy document so we can read outputs
    var doc = new Grasshopper.Kernel.GH_Document();
    doc.AddObject(circles, false);

    //read output circles
    circles.Params.Output[0].CollectData();
    //for (int i = 0; i < circles.Params.Output.Count - 1; ++i)
    for(int i = 0; i < delaunayMesh.Faces.Count; ++i)
    {

      list.Add(circles.Params.Output[0].VolatileData.get_Branch(0)[i]);

    }

    var arcsList = new System.Collections.Generic.List<object>();

    var arcs = new AnalysisComponents.Component_DeconstructArc();
    var arcParams = arcs.Params.Input[0] as Grasshopper.Kernel.GH_PersistentParam<Grasshopper.Kernel.Types.GH_Arc>;
    arcParams.PersistentData.ClearData();
    var circle = new Arc[delaunayMesh.Faces.Count];
    for(int i = 0; i < list.Count; ++i)
    {

      GH_Convert.ToArc(list[i], ref circle[i], GH_Conversion.Both);
      arcParams.PersistentData.Append(new GH_Arc(circle[i]));

    }

    arcs.ExpireSolution(true);
    var docOne = new Grasshopper.Kernel.GH_Document();
    docOne.AddObject(arcs, false);

    arcs.Params.Output[0].CollectData();
    for(int i = 0; i < delaunayMesh.Faces.Count; ++i)
    {

      arcsList.Add(arcs.Params.Output[1].VolatileData.get_Branch(0)[i]);

    }

    var faceMesh = new List<object>();

    var deMesh = new SurfaceComponents.MeshComponents.Component_DeconstructMesh();
    var meshParams = deMesh.Params.Input[0] as Grasshopper.Kernel.GH_PersistentParam<Grasshopper.Kernel.Types.GH_Mesh>;
    meshParams.PersistentData.ClearData();
    meshParams.PersistentData.Append(new GH_Mesh(delaunayMesh));

    deMesh.ExpireSolution(true);
    var docTwo = new Grasshopper.Kernel.GH_Document();
    docTwo.AddObject(deMesh, false);

    deMesh.Params.Output[0].CollectData();
    for(int i = 0; i < delaunayMesh.Faces.Count; ++i)
    {

      faceMesh.Add(deMesh.Params.Output[1].VolatileData.get_Branch(0)[i]);

    }

    A = faceMesh;
# ---------- end c_script ----------
circle = Circle(facec.Centers)
sort = SortList(Keys=darc.Radius, ValuesA=demesh.Faces)  # -> Keys, ValuesA
lng = ListLength(List=demesh.Faces)
splitlist = CSharpScript()  # -> out, A; inputs x: list, y: Int32
# ---------- splitlist: C# ----------
    //x.Reverse();

    var points = new List<object>();

    var chunk = Chunk(x, y, x.Count);

    foreach(var item in chunk)
    {

      //item.Reverse();
      points = item.ToList();

    }

    A = points;
# ---------- splitlist: C# additional code ----------
  public static IEnumerable<IEnumerable<T>> Chunk<T> (IEnumerable<T> source, int chunksize, int count)
  {
    while (source.Any())
    {
      yield return source.Take(chunksize);
      source = source.Skip(chunksize + count);
    }
  }

  public static IEnumerable<IEnumerable<T>> Split<T>(IEnumerable<T> source, int chunkSize)
  {

    var chunk = new List<T>(chunkSize);
    foreach (var item in source)
    {
      chunk.Add(item);
      if (chunk.Count == chunkSize)
      {
        yield return chunk;
        chunk.Clear();
      }
    }

    if (chunk.Count > 0)
    {
      yield return chunk;
    }
  }
# ---------- end splitlist ----------
multiplication = Multiplication(A=lng, B=attrition)
panel = Panel(c_script.A)
panel_2 = Panel(demesh.Faces)
split = SplitList(List=sort.ValuesA, Index=multiplication)  # -> ListA, ListB
conmesh = ConstructMesh(Vertices=demesh.Vertices, Faces=split.ListA)
medges = MeshEdges(Mesh=conmesh)  # -> NakedEdges, InteriorEdges, NonManifoldEdges
join = JoinCurves(Curves=medges.NakedEdges, Preserve=False)
